# Grasshopper definition Paperhopper_1_CALIBRATION.gh (Grasshopper 1.0.7)
# plug-ins: Human, gHowl, LunchBox, Telepathy

panel = Panel("""in
mm
m
km
ft
cm""")
# PaperHopper
# github.com/dantaeyoung/paperhopper
# Dan Taeyoung / @dantaeyoung
# Other Helper Tools
panel_2 = Panel("1")
concat = Concatenate(FragmentA=panel_2, FragmentB=panel)
docunits = ConvertToDocumentUnits(ValueString=concat)
equals = Equality(FirstNumber=docunits, SecondNumber=panel_2)  # -> Equality, Inequality
dispatch = Dispatch(List=panel, DispatchPattern=equals.Equality)  # -> ListA, ListB
# Paperhopper_1_CALIBRATION
# -- CALIBRATION:
# 
# This file calibrates the camera and the projection!
# 
# If you have calibrated: Great!
# 
# Open Paperhopper_2_PLAY_TEMPLATE, save it as a new file, then start playing.
# 
# -- PLUGINS:
# 
# This file requires several crucial plugins:
# - Human
# - gHowl
# - Lunchbox
# - Telepathy
# - Bengesht
# If you see errors, then load the plugins into Grasshopper, then close without saving and reopen this file.
# The plugins are conveniently collected in the gh_plugins folder.
panel_3 = Panel(dispatch.ListA)
probabledocumentunit = RemoteSender(dispatch.ListA)

calibration_button = Button()

# ----
# 2. Use the 'Camera' app in Windows to preview your camera and to make sure it works!
# 3. Turn on Reactivision.exe. Test if it works with a marker.
calibration_button_2 = RemoteSender(calibration_button)
construct_point = ConstructPoint(XCoordinate=Slider(0.278, range=0..1), YCoordinate=Slider(0.307, range=0..1), ZCoordinate=0)
construct_point_2 = ConstructPoint(XCoordinate=Slider(0.921, range=0..1), YCoordinate=Slider(0.827, range=0..1), ZCoordinate=0)
# v0.2
# SETUP / CALIBRATION
panel_4 = Panel("Paperhopper")
# 1. Create a rectangle in Rhino to represent the playspace, and reference it
createplayspacerectangle = CreatePlayspaceRectangle(viewname=panel_4, point=construct_point, point_2=construct_point_2)
geometry = Geometry(createplayspacerectangle)
# 4. See if this works. If not, follow these instructions:
listentoreactivision = BooleanToggle(True)
# 6. Turn on debug/demo to see if things work!
# 7. Great! You've finished calibrating!
# The calibration information has been saved to a file called 'calibration.csv'.
# Make sure this file is always in the same directory as your definitions.
# 
# You can now open Paperhopper_2_PLAY.gh.
turn_on_debug = BooleanToggle(True)

# ---- group: This is the geometry in Rhino
playspacerectangleraw = Geometry(geometry)

# ----
calibration_button_3 = RemoteReceiver(calibration_button_2)
filter = StreamFilter(Gate=listentoreactivision, Stream1="3333")
udp = UDPReceiver(Port=filter, Pattern="999")  # -> Info, Data
playspacerectangle = RemoteSender(playspacerectangleraw)
loadcalibrationdata = LoadCalibrationData(update=calibration_button_3)  # -> calibrationmmv, calibrationadjustment
# Some quick shortcuts:
# o: brings up the camera option menu
# F1: toggles fullscreen
# s: Displays the source image (what the camera sees)
# t: Displays the target image (the processed image)
# h: Displays help text
troubleshoot = Troubleshoot(T=udp.Info)  # -> message_2, screenwarning_2, screenmessage_2
turn_on_debug_2 = RemoteSender(turn_on_debug)
texttoscreen = RenderTextToScreen(
    Text=troubleshoot.screenmessage_2,
    Location=Point(84.2174437, 130.7142421, 0),
    Size=35,
    Color=RGB(209, 106, 54),
    m_scWithvp=False)
calibration_button_4 = RemoteReceiver(calibration_button_2)
panel_5 = Panel(troubleshoot.message_2)
calibrationreactivision = CalibrationReactivision(
    reset=Button(),
    data=udp.Data,
    mmv=loadcalibrationdata.calibrationmmv,
    calibrationadjustment=loadcalibrationdata.calibrationadjustment)  # -> rawplanes_2, rawanglesfrom0to1_2, calibratedids_2, calibratedanglesfrom0to1_2, calibratedplanes, timestamp

# ---- group: Count to 5
rec = DataRecorder(calibration_button_4, DataLimit=-10, RecordData=True)
int = Integer(rec)
ma = MassAddition(Input=["0", int])  # -> Result, PartialResults
mod = Modulus(A=ma.Result, B="5")

# ----
rawplanes = RemoteSender(calibrationreactivision.rawplanes_2)
rawanglesfrom0to1 = RemoteSender(calibrationreactivision.rawanglesfrom0to1_2)
calibratedids = RemoteSender(calibrationreactivision.calibratedids_2)
calibratedplanes = RemoteSender(calibrationreactivision.calibratedplanes)
calibrationtimestamp = RemoteSender(calibrationreactivision.timestamp)
calibratedanglesfrom0to1 = RemoteSender(calibrationreactivision.calibratedanglesfrom0to1_2)
equals_2 = Equality(FirstNumber=mod, SecondNumber="4")  # -> Equality, Inequality
arewecalibrating = RemoteSender(equals_2.Inequality)
calibrationnum = RemoteSender(mod)
calibrationnum_2 = RemoteReceiver(calibrationnum)
data = Data([Point(0.06739937, 0.6623541, 0), Point(0.7602807, 0.06021344, 0), Point(0.795, 0.7469994, 0), Point(0.04077507, 0.776425, 0)])
data_2 = Data([Point(0.06105579, 0.0926334, 0), Point(0.7596885, 0.06048672, 0), Point(0.7964689, 0.7436158, 0), Point(0.03925141, 0.7763936, 0)])
equals_3 = Equality(FirstNumber=calibrationnum_2, SecondNumber="4")  # -> Equality, Inequality
panel_6 = Panel(data)
panel_7 = Panel(data_2)
distance = Distance(PointA=panel_6, PointB=panel_7)
panel_8 = Panel(distance)
turn_on_debug_3 = RemoteReceiver(turn_on_debug_2)
calibratedplanes_2 = RemoteReceiver(calibratedplanes)
calibratedanglesfrom0to1_2 = RemoteReceiver(calibratedanglesfrom0to1)
md_slider = MDSlider(
    SliderMode=0,
    slider_value=Point(0.8461991674, 0.7084835737, 0.5),
    x_domain=Domain(-30, 30),
    y_domain=Domain(-30, 30),
    z_domain=Domain(0, 1))
filter_2 = StreamFilter(Gate=turn_on_debug_3, Stream1=calibratedplanes_2)
number_slider = Slider(55, range=0..100)
calibratedids_2 = RemoteReceiver(calibratedids)
deplane = DeconstructPlane(Plane=filter_2)  # -> Origin, XAxis, YAxis, ZAxis

# ---- group: fine-tuned adjustments
md_slider_2 = MDSlider(
    SliderMode=0,
    slider_value=Point(0.5008589582, 0.5050629406, 0.5),
    x_domain=Domain(-10, 10),
    y_domain=Domain(-10, 10),
    z_domain=Domain(0, 1))

# ----
playspacerectangle_2 = RemoteReceiver(playspacerectangle)

# ---- group: Edit me
# 1.1 Looking at the rectangle projected on the table,
# estimate/measure the length of the diagonal,
# using the same units as in your Rhino window
reallifeplayspace_diagonal_length = Panel("33")  # disabled

# ----
pdecon = Deconstruct(Point=deplane.Origin)  # -> XComponent, YComponent, ZComponent
move = Move(Geometry=deplane.Origin, Motion=md_slider)  # -> Geometry, Transform
multiplication = Multiplication(A=calibratedanglesfrom0to1_2, B="360")
gradient = Gradient(
    LowerLimit="0",
    UpperLimit="360",
    Parameter=multiplication,
    stops=[0: RGB(243, 57, 0), 0.1: RGB(236, 27, 60), 0.2: RGB(210, 0, 118), 0.3: RGB(103, 0, 120), 0.4: RGB(39, 72, 161), 0.5: RGB(1, 192, 229), 0.6: RGB(18, 178, 90), 0.7: RGB(79, 186, 8), 0.8: RGB(220, 237, 32), 0.9: RGB(247, 159, 20), 1: RGB(243, 57, 0)])
pln = Plane(filter_2)
line = LineSDL(Start=deplane.Origin, Direction=deplane.XAxis, Length=number_slider)
line_2 = LineSDL(Start=deplane.Origin, Direction=deplane.YAxis, Length=number_slider)
calibrationtimestamp_2 = RemoteReceiver(calibrationtimestamp)
dim = Dimensions(Surface=playspacerectangle_2)  # -> UDimension, VDimension
cir = Circle(Plane=PlaneXY(0, 0, 0), Radius=1)
calibrationadjustment = RemoteSender(md_slider_2)
calibrationadjustment_2 = RemoteReceiver(calibrationadjustment)
rawplanes_2 = RemoteReceiver(rawplanes)
concat_2 = Concatenate(
    FragmentH="ID: ",
    FragmentG=calibratedids_2,
    FragmentF="x: ",
    FragmentA=pdecon.XComponent,
    FragmentB=", y: ",
    FragmentC=pdecon.YComponent,
    FragmentD="rot: ",
    FragmentE=multiplication)
timer = Timer(TimerInterval=1000, Target=gettimestamp)
# Generate encoded calibration data and save to file
playspacerectangle_3 = RemoteReceiver(playspacerectangle)
expression = Expression(x=dim.UDimension, y=dim.VDimension, Expression="sqrt(x^2 + y^2)")
playspacerectangle_4 = RemoteReceiver(playspacerectangle)
irl_playspace_diagonal = RemoteSender(reallifeplayspace_diagonal_length)  # disabled
gettimestamp = GetTimestamp()
swatch = ColourSwatch(SwatchColor=RGB(255, 255, 255))
# Don't edit stuff to the right of the line unless you know what you're doing
number_slider_2 = Slider(8, range=0..10)
playspacerectangle_5 = RemoteReceiver(playspacerectangle)
arewecalibrating_2 = RemoteReceiver(arewecalibrating)
playspacerectangle_6 = RemoteReceiver(playspacerectangle)
bbox = BoundingBox(Content=playspacerectangle_4, Plane=PlaneXY(0, 0, 0))  # -> Box, Box_2
previewlw = CustomPreviewLineweights(
    Geometry=[line, line_2],
    Shader={diffuse=RGB(255, 105, 180), emission=RGB(76, 32, 54), shine=0.5, specular=RGB(255, 255, 255), transparency=0},
    Thickness=Slider(6, range=0..10),
    Absolute=False)
subtraction = Subtraction(A=gettimestamp, B=calibrationtimestamp_2)
panel_9 = Panel(expression)
irl_playspace_diagonal_2 = RemoteReceiver(irl_playspace_diagonal)
uncalibratedflatplane = RemoteSender(rawplanes_2)
uncalibratedflatplane_2 = RemoteReceiver(uncalibratedflatplane)
clean = CleanTree(RemoveNulls=True, RemoveInvalid=True, RemoveEmpty=True, Tree=uncalibratedflatplane_2)  # -> flatten(Tree)
item = ListItem(List=clean, Index=0, Wrap=True)
geo = Geometry(flatten(item))
panel_10 = Panel(geo)
storecalibpoints = StoreCalibPoints(pt=geo, calib_point_id=calibrationnum_2)
expire_dam = ExpireDam(Expire=equals_3.Inequality, InputValue=storecalibpoints)
calibration4pts = RemoteSender(expire_dam)
uncalibratedflatplane_3 = RemoteReceiver(uncalibratedflatplane)
clean_2 = CleanTree(RemoveNulls=True, RemoveInvalid=True, RemoveEmpty=False, Tree=uncalibratedflatplane_3)  # -> flatten(Tree)
# Calibration - create transformation matrix
calibration4pts_2 = RemoteReceiver(calibration4pts)
list_length = ListLength(List=clean_2)
item_2 = ListItem(List=calibration4pts_2, Index=0, Wrap=True)  # -> Item, Item1, Item2, Item3
xy = XYPlane(Origin=Point(0, 0, 0))
box_corners = BoxCorners(Box=bbox.Box)  # -> CornerA, CornerB, CornerC, CornerD, CornerE, CornerF, CornerG, CornerH
minimum = Minimum(A=list_length, B="2")
# Calibration UI display
swatch_2 = ColourSwatch(SwatchColor=RGB(178, 36, 255))
smaller = SmallerThan(FirstNumber=subtraction, SecondNumber="2")  # -> SmallerThan, OrEqualTo
filter_3 = StreamFilter(Gate=arewecalibrating_2, Stream1=playspacerectangle_5)
bbox_2 = BoundingBox(Content=playspacerectangle_6, Plane=xy)  # -> Box, Box_2

# ---- group: To Surface
m_from_points = MFromPoints(pt_2=box_corners.CornerA, pt_3=box_corners.CornerB, pt=box_corners.CornerC, pt_4=box_corners.CornerD)

# ---- group: From Surface
m_from_points_2 = MFromPoints(pt_2=item_2.Item, pt_3=item_2.Item1, pt=item_2.Item2, pt_4=item_2.Item3)

# ----
division = Division(A=panel_9, B=irl_playspace_diagonal_2)
arewecalibrating_3 = RemoteReceiver(arewecalibrating)
control_points = ControlPoints(Curve=filter_3)  # -> Points, Weights, Knots
reactivisionisworking = RemoteSender(smaller.SmallerThan)
reactivisionisworking_2 = RemoteReceiver(reactivisionisworking)
probabledocumentunit_2 = RemoteReceiver(probabledocumentunit)  # disabled
area = Area(Geometry=bbox_2.Box)  # -> Area, Centroid
projectionscale_rhinooverirl = RemoteSender(division)
projectionscale_rhinooverirl_2 = RemoteReceiver(projectionscale_rhinooverirl)
multiplication_2 = Multiplication(A=projectionscale_rhinooverirl_2, B=Slider(0.7, range=0..4))
projectionscale_rhinooverirl_3 = RemoteReceiver(projectionscale_rhinooverirl)  # disabled
tag = TextTag3D(Location=move.Geometry, Text=concat_2, Size=multiplication_2, Colour=gradient, Justification=7)
panel_11 = Panel(projectionscale_rhinooverirl_3)  # disabled
createmmv = CreateMMV(M=m_from_points, M_2=m_from_points_2)
createmmv_2 = CreateMMV(M=m_from_points_2, M_2=m_from_points)
area_2 = Area(Geometry=bbox_2.Box)  # -> Area, Centroid
box_corners_2 = BoxCorners(Box=bbox_2.Box)  # -> CornerA, CornerB, CornerC, CornerD, CornerE, CornerF, CornerG, CornerH
panel_12 = Panel(calibrationreactivision.rawplanes_2)
reversemmv = RemoteSender(createmmv)
reversemmv_2 = RemoteReceiver(reversemmv)
button = Button()  # disabled
split_list = SplitList(List=control_points.Points, Index="1")  # -> ListA, ListB
calibrationmmv = RemoteSender(createmmv_2)
calibrationmmv_2 = RemoteReceiver(calibrationmmv)
encodecalibrationdata = EncodeCalibrationData(_0_0=calibrationmmv_2, _0_1=calibrationadjustment_2, playspacerectangle=playspacerectangle_3, reversemmv=reversemmv_2)  # -> jsondump, b64dump
panel_13 = Panel(calibrationmmv_2)
calibrationjson = RemoteSender(encodecalibrationdata.jsondump)
# 5. Move a single marker and calibrate along the PlayspaceRectangle.
# The screen should give you feedback as to what to do.
calibrationjson_2 = RemoteReceiver(calibrationjson)
decodecalibrationdata = DecodeCalibrationData_2(jsondump=calibrationjson_2)  # -> calibrationmmv_2, calibrationadjustment_2, playspacerectanglepts_2, reversemmv_2
calibrationjson_3 = RemoteReceiver(calibrationjson)
swatch_3 = ColourSwatch(SwatchColor=RGB(255, 0, 0))
your_units_are_probably = Panel(probabledocumentunit_2)  # disabled
# 4.5 Save the current view!
viewname = Panel("PaperHopper")  # disabled
writecalibrationfile = WriteCalibrationFile(jsondump=encodecalibrationdata.jsondump)  # -> out, updated
calibrationnum_3 = RemoteReceiver(calibrationnum)
filter_4 = StreamFilter(Gate=minimum, Stream0=swatch_3, Stream1=ColourSwatch(SwatchColor=RGB(6, 108, 204)), Stream2=swatch_3)
filter_5 = StreamFilter(
    Gate=minimum,
    Stream0="MARKER NOT VISIBLE",
    Stream1="Marker is OK - press calibration button",
    Stream2="TOO MANY MARKERS")
data_3 = Data(calibrationjson_3)
merge = Merge(
    Data1=box_corners_2.CornerA,
    Data2=box_corners_2.CornerB,
    Data3=box_corners_2.CornerC,
    Data4=box_corners_2.CornerD,
    Data5=area_2.Centroid)
circle = Circle(Plane=split_list.ListB, Radius=Slider(22, range=0..100))

# ---- group: Datadam Toggle
# Reload the current view
rec_2 = DataRecorder(button, DataLimit=-10, RecordData=True)  # disabled
panel_14 = Panel("0")  # disabled
addition = Addition(A=panel_14, B=rec_2)  # disabled
ma_2 = MassAddition(Input=addition)  # -> Result, PartialResults; disabled
dam = DataDam(DataA=ma_2.Result, BufferDelay=10000000, BufferMode=2)  # disabled
equals_4 = Equality(FirstNumber=dam, SecondNumber=ma_2.Result)  # -> Equality, Inequality; disabled
bool = Boolean(equals_4.Inequality)  # disabled

# ----
# Save current view
panel_15 = Panel("! _-NamedView _Save {} _EnterEnd")  # disabled
panel_16 = Panel(data_3)
# Go Fullscreen
panel_17 = Panel("! -_Options _Appearance _Visibility _ViewportTitles Hide _Menu Hide _CommandPrompt Hide _StatusBar Hide _WindowTitle Hide _EnterEnd -_ViewportTabs Hide _EnterEnd -_Fullscreen _DisableEscape _EnterEnd Yes  ")  # disabled
filter_6 = StreamFilter(Gate=reactivisionisworking_2, Stream0="Reactivision is NOT RUNNING", Stream1=filter_5)
trim_with_regions = TrimWithRegions(Curve=filter_3, Regions=circle)  # -> Inside, Outside
item_3 = ListItem(List=merge, Index=calibrationnum_3, Wrap=True)
reloadcalibration = RemoteSender(writecalibrationfile.updated)
panel_18 = Panel("! _-NamedView _Restore {} ! _EnterEnd !")  # disabled
getactiveviewport = GetActiveViewport(trigger=bool)  # disabled
panel_19 = Panel(reactivisionisworking_2)
seeingspaceviewportname = RemoteSender(viewname)  # disabled
seeingspaceviewportname_2 = RemoteReceiver(seeingspaceviewportname)  # disabled
panel_20 = Panel("""Lower Left
Lower Right
Upper Right
Upper Left
Calibrated!""")
pt = Point(item_3)
panel_21 = Panel("{}")  # disabled
playspacerectangle_7 = RemoteReceiver(playspacerectangle)
toggle = BooleanToggle(True)  # disabled
toggle_2 = BooleanToggle(False)  # disabled
previewlw_2 = CustomPreviewLineweights(Geometry=[trim_with_regions.Outside, circle], Shader=swatch_2, Thickness=number_slider_2, Absolute=False)
rep = ReplaceText(Text=panel_15, Find=panel_21, Replace=seeingspaceviewportname_2, RecursiveReplace=False)  # disabled
panel_22 = Panel("{}")  # disabled
cir_2 = Circle(Plane=pt, Radius=Slider(31, range=0..100))
calibrationnum_4 = RemoteReceiver(calibrationnum)
rep_2 = ReplaceText(Text=panel_18, Find=panel_22, Replace=getactiveviewport, RecursiveReplace=False)  # disabled
dot_display = DotDisplay(Point=split_list.ListB, Colour=swatch_2, Size=Slider(1, range=0..10))
ccx = CurveCurve(CurveA=playspacerectangle_7, CurveB=cir_2)  # -> Points, ParamsA, ParamsB
rhcom = RhinoCommand(SendCommandToggle=toggle, CommandString=panel_17)  # disabled
item_4 = ListItem(List=panel_20, Index=calibrationnum_4, Wrap=True)
rhcom_2 = RhinoCommand(SendCommandToggle=toggle_2, CommandString=rep)  # disabled
arewecalibrating_4 = RemoteReceiver(arewecalibrating)
panel_23 = Panel(rep)  # disabled
pline = PolyLine(Vertices=ccx.Points, Closed=False)
rhcom_3 = RhinoCommand(SendCommandToggle=bool, CommandString=rep_2)  # disabled
curvepoint = PointOnCurve(pline, parameter=0.5)
concat_3 = Concatenate(FragmentA="Move marker to ", FragmentB=item_4, FragmentD=" corner", FragmentC=filter_6)
filter_7 = StreamFilter(Gate=arewecalibrating_4, Stream1=area.Centroid)
vec2pt = Vector2Pt(PointA=pt, PointB=curvepoint, Unitize=False)  # -> Vector, Length
tag_2 = TextTag3D(Location=filter_7, Text=concat_3, Size=Slider(14, range=0..100), Colour=filter_4, Justification=8)
amp = Amplitude(Vector=vec2pt.Vector, Amplitude=Slider(50, range=0..50))
rev = Reverse(Vector=amp)
move_2 = Move(Geometry=curvepoint, Motion=amp)  # -> Geometry, Transform
vdisex = VectorDisplayEx(Point=move_2.Geometry, Vector=rev, Colour=filter_4, Width=Slider(10, range=0..10))

# ==== cluster MFromPoints
pt = ClusterInput()
pt_2 = ClusterInput()
pt_3 = ClusterInput()
pt_4 = ClusterInput()
pt_5 = Point(pt)
pt_6 = Point(pt_2)
pt_7 = Point(pt_3)
pt_8 = Point(pt_4)
pdecon = Deconstruct(Point=pt_6)  # -> XComponent, YComponent, ZComponent
pdecon_2 = Deconstruct(Point=pt_7)  # -> XComponent, YComponent, ZComponent
pdecon_3 = Deconstruct(Point=pt_5)  # -> XComponent, YComponent, ZComponent
pdecon_4 = Deconstruct(Point=pt_8)  # -> XComponent, YComponent, ZComponent
merge = Merge(Data1=flatten(pdecon_3.XComponent), Data2=flatten(pdecon_3.YComponent), Data3=flatten("1"))
merge_2 = Merge(Data1=flatten(pdecon.XComponent), Data2=flatten(pdecon.YComponent), Data3=flatten("1"))
merge_3 = Merge(Data1=flatten(pdecon_2.XComponent), Data2=flatten(pdecon_2.YComponent), Data3=flatten("1"))
merge_4 = Merge(Data1=flatten(pdecon_4.XComponent), Data2=flatten(pdecon_4.YComponent), Data3=flatten("1"))
merge_5 = Merge(Data1=merge_2, Data2=merge_3, Data3=merge)
matrix = ConstructMatrix(Rows=Slider(1, range=1..3), Columns=Slider(3, range=1..3), Values=merge_4)
matrix_2 = DisplayMatrix(matrix)
matrix_3 = ConstructMatrix(Rows=Slider(3, range=1..3), Columns=Slider(3, range=1..3), Values=merge_5)
minvert = InvertMatrix(Matrix=matrix_3, Tolerance=0)  # -> Matrix, Success
multiplication = Multiplication(A=matrix, B=minvert.Matrix)
d = Matrix(multiplication)
dematrix = DeconstructMatrix(Matrix=d)  # -> Rows, Columns, Values
item = ListItem(List=dematrix.Values, Index=0, Wrap=True)  # -> Item, Item1, Item2
panel = Panel(dematrix.Values)
matrix_4 = DisplayMatrix(d)
multiplication_2 = Multiplication(A=item.Item, B=pdecon.XComponent)
multiplication_3 = Multiplication(A=item.Item1, B=pdecon_2.XComponent)
multiplication_4 = Multiplication(A=item.Item1, B=pdecon_2.YComponent)
multiplication_5 = Multiplication(A=item.Item, B=pdecon.YComponent)
multiplication_6 = Multiplication(A=item.Item2, B=pdecon_3.YComponent)
multiplication_7 = Multiplication(A=item.Item2, B=pdecon_3.XComponent)
merge_6 = Merge(Data1=multiplication_2, Data2=multiplication_5, Data3=item.Item)
merge_7 = Merge(Data1=multiplication_3, Data2=multiplication_4, Data3=item.Item1)
merge_8 = Merge(Data1=multiplication_7, Data2=multiplication_6, Data3=item.Item2)
merge_9 = Merge(Data1=merge_6, Data2=merge_7, Data3=merge_8)
matrix_5 = ConstructMatrix(Rows=Slider(3, range=1..3), Columns=Slider(3, range=1..3), Values=merge_9)
M = Matrix(matrix_5)
M_2 = ClusterOutput(M)

# ==== cluster GetActiveViewport
trigger = ClusterInput()
getactiveviewport = GhPythonScript(trigger=trigger)  # -> out, vp
# ---------- getactiveviewport: Python ----------
import Rhino
import scriptcontext

def ActiveViewport():
    view = scriptcontext.doc.Views.ActiveView
    if view is None: return
    if isinstance(view, Rhino.Display.RhinoPageView):
        if view.PageIsActive:
            print "The layout", view.PageName, "is active"
        else:
            detail_name = view.ActiveViewport.Name
            print "The detail", detail_name, "on layout", view.PageName, "is active"
    else:
        print "The viewport", view.MainViewport.Name, "is active"
        scriptcontext.doc.Views.Redraw()
        return view.MainViewport.Name
       


if __name__ == "__main__":
    vp = ActiveViewport()
# ---------- end getactiveviewport ----------
vp = ClusterOutput(getactiveviewport.vp)

# ==== cluster CreateMMV
M = ClusterInput()
M_2 = ClusterInput()

M_3 = Matrix(M)
M_4 = Matrix(M_2)
minvert = InvertMatrix(Matrix=M_3, Tolerance=0)  # -> Matrix, Success
multiplication = Multiplication(A=minvert.Matrix, B=M_4)
m1_1m2 = Matrix(multiplication)

panel = Panel(":")
dematrix = DeconstructMatrix(Matrix=m1_1m2)  # -> Rows, Columns, Values
mmv = Number(dematrix.Values)
mmv_2 = ClusterOutput(mmv)

# ==== cluster EncodeCalibrationData
playspacerectangle = ClusterInput()
playspacerectangle_2 = Geometry(playspacerectangle)
reversemmv = ClusterInput()
_0_1 = ClusterInput()
_0_0 = ClusterInput()
reversemmv_2 = Data(reversemmv)
control_points = ControlPoints(Curve=playspacerectangle_2)  # -> Points, Weights, Knots
panel = Panel("""CalibrationMMV
CalibrationAdjustment
PlayspaceRectanglePts
ReverseMMV""")
split_list = SplitList(List=control_points.Points, Index="1")  # -> ListA, ListB
entwine = Entwine(Branch00=_0_0, Branch01=_0_1, Branch02=split_list.ListB, Branch03=reversemmv_2, FlattenInputs=True)
serializedata = SerializeData(keys=panel, vals=entwine)  # -> jsondump, or_2, b64dump
panel_2 = Panel(serializedata.jsondump)
b64dump = ClusterOutput(serializedata.b64dump)
jsondump = ClusterOutput(serializedata.jsondump)

# ==== cluster WriteCalibrationFile
_0 = ClusterInput()
jsondump = ClusterInput()
combine = CombineData(Input0=_0, Input1="calibration.csv")  # -> Result, Index
gh_filepath = GHFilepath()  # -> filepath, filedir
panel = Panel(gh_filepath.filepath)
writecalibrationfile = GhPythonScript(filedir=gh_filepath.filedir, filename=combine.Result, jsondump=jsondump)  # -> out, updated
# ---------- writecalibrationfile: Python ----------
import ghpythonlib.treehelpers as th
import json
import os 


filepath = os.path.join(filedir, filename)


with open(filepath, "w") as f:
    f.write(jsondump)
    print("Saved to " + filepath + "!")
    updated = True
# ---------- end writecalibrationfile ----------
out = ClusterOutput(writecalibrationfile.out)
updated = ClusterOutput(writecalibrationfile.updated)

# ==== cluster LoadCalibrationData
optional_filename = ClusterInput()
update = ClusterInput()
readcalibrationfile = ReadCalibrationFile(update=update, _0=optional_filename)
decodecalibrationdata = DecodeCalibrationData(jsondump=readcalibrationfile)  # -> calibrationmmv_2, calibrationadjustment_2
calibrationmmv = ClusterOutput(decodecalibrationdata.calibrationmmv_2)
calibrationadjustment = ClusterOutput(decodecalibrationdata.calibrationadjustment_2)

# ==== cluster GetTimestamp: #GetTimestamp
input = ClusterInput()
python = GhPythonScript(input=input)  # -> out, timestamp
# ---------- python: Python ----------
import time
timestamp = int(round(time.time()))
# ---------- end python ----------
timestamp = ClusterOutput(python.timestamp)

# ==== cluster StoreCalibPoints
calib_point_id = ClusterInput()
pt = ClusterInput()
python = GhPythonScript(pt=pt, calib_point_id=calib_point_id)  # -> out, calib_points; inputs pt: Point3d, calib_point_id: Int32
# ---------- python: Python ----------
from scriptcontext import sticky as sc

if "calib_points" not in sc:
    sc["calib_points"] = {}
    
if (pt is not None and calib_point_id is not None):
    sc["calib_points"][calib_point_id] = pt

calib_points = [sc["calib_points"][i] if i in sc["calib_points"] else None for i in xrange(4)]
# ---------- end python ----------
calib_points = ClusterOutput(python.calib_points)

# ==== cluster CalibrationReactivision
data = ClusterInput()
reactivision_osc_to_planes = ReactivisionOscToPlanes(data=data)  # -> id_2, pln_2, angle_2
planes = Plane(reactivision_osc_to_planes.pln_2)
angles = Number(reactivision_osc_to_planes.angle_2)
ids = Number(reactivision_osc_to_planes.id_2)
reset = ClusterInput()
getallkeysseensofar = GetAllKeysSeenSoFar(reset=reset, ids=ids)  # -> simplify(graft(allkeys))
equals = Equality(FirstNumber=getallkeysseensofar, SecondNumber=ids)  # -> Equality, Inequality
dispatch = Dispatch(List=angles, DispatchPattern=equals.Equality)  # -> graft(ListA), ListB
dispatch_2 = Dispatch(List=planes, DispatchPattern=equals.Equality)  # -> graft(ListA), ListB

calibratedids = Number(simplify(getallkeysseensofar))
rawplanes = Plane(simplify(dispatch_2.ListA))
rawangles = Number(simplify(dispatch.ListA))

calibrationadjustment = ClusterInput()
mmv = ClusterInput()
division = Division(A=rawangles, B="Pi * 2")
rawplanes_2 = ClusterOutput(rawplanes)
calibratedids_2 = ClusterOutput(calibratedids)
rawanglesfrom0to1 = Number(simplify(division))
calibration = Calibration(uncalibratedflatplane=rawplanes, mmv=mmv, T=calibrationadjustment)
python = GhPythonScript(input=data)  # -> out, timestamp; inputs input: tree; same code as python
rawanglesfrom0to1_2 = ClusterOutput(rawanglesfrom0to1)

# ---- group: MAYBE TODO: add calibration rotation
calibratedanglesfrom0to1 = Number(rawanglesfrom0to1)

# ----
calibratedplanes = ClusterOutput(calibration)
timestamp = ClusterOutput(python.timestamp)
calibratedanglesfrom0to1_2 = ClusterOutput(calibratedanglesfrom0to1)

# ==== cluster Troubleshoot
panel = Panel("""ERROR: It looks like you have another Grasshopper definition that's listening to Reactivision! 

1. Close the other definition
2. Delete the ">UDP<" component
3. Hit Ctrl-Z to undo

This should work.

If it still doesn't work, try restarting Rhino.""")
panel_2 = Panel("""WARNING: We are listening for messages but not receiving any. 

Is Reactivision on?""")
panel_3 = Panel("""We are receiving messages.

Looks like everything is working great!""")
panel_4 = Panel("""*Listening for*
*No new message*""")
display_warning_text = BooleanToggle(True)
T = ClusterInput()
display_warning_text_2 = BooleanToggle(False)
tmatch = MatchText(Text=T, Pattern=panel_4, Case=True)
display_warning_text_3 = BooleanToggle(True)
tmatch_2 = MatchText(Text=T, Pattern="*A new message*", Case=True)
tmatch_3 = MatchText(Text=T, Pattern="AddressAlreadyInUse*", Case=True)
ma = MassAddition(Input=tmatch)  # -> Result, PartialResults
filter = StreamFilter(Gate=tmatch_2, Stream1=display_warning_text_2)
filter_2 = StreamFilter(Gate=tmatch_2, Stream1=panel_3)
filter_3 = StreamFilter(Gate=tmatch_3, Stream1=panel)
filter_4 = StreamFilter(Gate=tmatch_3, Stream1=display_warning_text)
bool = Boolean(ma.Result)
filter_5 = StreamFilter(Gate=bool, Stream1=display_warning_text_3)
filter_6 = StreamFilter(Gate=bool, Stream1=panel_2)
concat = Concatenate(FragmentA=filter_3, FragmentB=filter_2, FragmentC=filter_6)
or = GateOr(A=filter_4, B=filter, C=filter_5)
screenwarning = Boolean(or)
message = Text(concat)
filter_7 = StreamFilter(Gate=screenwarning, Stream1=message)
screenmessage = Text(filter_7)
message_2 = ClusterOutput(message)
screenwarning_2 = ClusterOutput(screenwarning)
screenmessage_2 = ClusterOutput(screenmessage)

# ==== cluster CreatePlayspaceRectangle
viewname = ClusterInput()
viewportrectangle = GhPythonScript(ViewName=viewname)  # -> out, viewpts, viewrect
# ---------- viewportrectangle: Python ----------
import Rhino
from scriptcontext import doc
import rhinoscriptsyntax
from ghpythonlib import components as gc


thisview = doc.Views.Find(ViewName, False)

if thisview is not None:
    
    viewpts =  thisview.MainViewport.GetNearRect()
    
    viewrect, _ = gc.Rectangle3Pt(point_a = viewpts[0], point_b = viewpts[1], point_c = viewpts[2])

"""

   Dim pts As Point3d() = view.MainViewport.GetNearRect()
   If (pts Is Nothing) Then
     Throw New Exception("View " & vp & " is not valid")
   End If

   Dim rec As New Polyline()
   rec.Add(pts(0))
   rec.Add(pts(1))
   rec.Add(pts(3))
   rec.Add(pts(2))
   rec.Add(pts(0))
"""
# ---------- end viewportrectangle ----------
point = ClusterInput()
point_2 = ClusterInput()
evaluate_surface = EvaluateSurface(Surface=reparameterize(viewportrectangle.viewrect), Point=point)  # -> Point, Normal, UDirection, VDirection, Frame
evaluate_surface_2 = EvaluateSurface(Surface=reparameterize(viewportrectangle.viewrect), Point=point_2)  # -> Point, Normal, UDirection, VDirection, Frame
xy_plane = XYPlane(Origin=Point(0, 0, 0))
rectangle_2pt = Rectangle2Pt(Plane=xy_plane, PointA=evaluate_surface.Point, PointB=evaluate_surface_2.Point, Radius=0)  # -> Rectangle, Length
rectangle = ClusterOutput(rectangle_2pt.Rectangle)

# ==== cluster DecodeCalibrationData_2
jsondump = ClusterInput()
b64dump = ClusterInput()
deserializedata = DEserializeData(jsondump=jsondump, b64dump=b64dump)  # -> keys, vals
bang = ExplodeTree(Data=deserializedata.vals)  # -> Branch0, Branch1, Branch2, Branch3
panel = Panel(deserializedata.keys)
calibrationadjustment = Point(bang.Branch1)
calibrationmmv = Number(bang.Branch0)
playspacerectanglepts = Point(bang.Branch2)
reversemmv = Number(bang.Branch3)
reversemmv_2 = ClusterOutput(reversemmv)
calibrationmmv_2 = ClusterOutput(calibrationmmv)
playspacerectanglepts_2 = ClusterOutput(playspacerectanglepts)
calibrationadjustment_2 = ClusterOutput(calibrationadjustment)

# ==== cluster SerializeData
keys = ClusterInput()
vals = ClusterInput()
python = GhPythonScript(keys=keys, vals=vals)  # -> out, jsondump, b64dump; inputs keys: tree, vals: tree
# ---------- python: Python ----------
import ghpythonlib.treehelpers as th
import json
import base64

vals = th.tree_to_list(vals)
keys = th.tree_to_list(keys)

if len(vals) != len(keys):
    print "Key/Value length mismatch"
else:
    d = { "keys": keys, "vals": vals }
    jsondump = json.dumps(d)
    b64dump = base64.b64encode(jsondump)
# ---------- end python ----------
or = Data()
or_2 = ClusterOutput(or)
jsondump = ClusterOutput(python.jsondump)
b64dump = ClusterOutput(python.b64dump)

# ==== cluster GHFilepath
get_gh_filepath = GetGHFilepath()  # -> filepath, filedir
filedir = ClusterOutput(get_gh_filepath.filedir)
panel = Panel(get_gh_filepath.filepath)
filepath = ClusterOutput(get_gh_filepath.filepath)

# ==== cluster DecodeCalibrationData
jsondump = ClusterInput()
b64dump = ClusterInput()
deserializedata = DEserializeData(jsondump=jsondump, b64dump=b64dump)  # -> keys, vals
bang = ExplodeTree(Data=deserializedata.vals)  # -> Branch0, Branch1
calibrationadjustment = Point(bang.Branch1)
calibrationmmv = Number(bang.Branch0)
calibrationmmv_2 = ClusterOutput(calibrationmmv)
calibrationadjustment_2 = ClusterOutput(calibrationadjustment)

# ==== cluster ReadCalibrationFile
update = ClusterInput()
_0 = ClusterInput()
update_2 = Data(update)
gh_filepath = GHFilepath()  # -> filepath, filedir
combine = CombineData(Input0=_0, Input1="calibration.csv")  # -> Result, Index
writecalibrationfile = GhPythonScript(update=update_2, filedir=gh_filepath.filedir, filename=combine.Result)  # -> out, jsondump
# ---------- writecalibrationfile: Python ----------
import ghpythonlib.treehelpers as th
import json
import os 


filepath = os.path.join(filedir, filename)

print filepath

with open(filepath, "r") as f:
    jsondump = f.read()
# ---------- end writecalibrationfile ----------
jsondump = ClusterOutput(writecalibrationfile.jsondump)
panel = Panel(writecalibrationfile.jsondump)

# ==== cluster GetAllKeysSeenSoFar
reset = ClusterInput()
ids = ClusterInput()
getallkeysseensofar = GhPythonScript(reset=reset, ids=ids)  # -> out, allkeys; inputs ids: list of Int32
# ---------- getallkeysseensofar: Python ----------
import scriptcontext

if reset or "ids" not in scriptcontext.sticky:
    scriptcontext.sticky["ids"] = {}


for id in ids:
    scriptcontext.sticky["ids"][id] = True
    
allkeys = sorted(scriptcontext.sticky["ids"].keys())
# ---------- end getallkeysseensofar ----------
allkeys = ClusterOutput(getallkeysseensofar.allkeys)

# ==== cluster ReactivisionOscToPlanes
data = ClusterInput()
data_2 = Data(data)
lng = ListLength(List=data_2)
series = Series(Start=0, Step=1, Count=lng)
tmatch = MatchText(Text=data_2, Pattern="set", Case=True)
dispatch = Dispatch(List=series, DispatchPattern=tmatch)  # -> ListA, ListB
item = ListItem(List=data_2, Index=dispatch.ListA, Wrap=True)  # -> Item, Item1, Item2, Item3, Item4, Item5
pt = ConstructPoint(XCoordinate=item.Item3, YCoordinate=item.Item4, ZCoordinate=0)
xy = XYPlane(Origin=pt)
prot = RotatePlane(Plane=xy, Angle=item.Item5)
angle = Number(item.Item5)
pln = Plane(prot)
id = Number(item.Item2)
id_2 = ClusterOutput(id)
pln_2 = ClusterOutput(pln)
angle_2 = ClusterOutput(angle)

# ==== cluster Calibration
uncalibratedflatplane = ClusterInput()
mmv = ClusterInput()
uncalibratedflatplane_2 = Plane(uncalibratedflatplane)
calibrationwithmmv = CalibrationWithMMV(pts=uncalibratedflatplane_2, mmv=mmv)
T = ClusterInput()
move = Move(Geometry=calibrationwithmmv, Motion=T)  # -> Geometry, Transform
pl_origin = PlaneOrigin(Base=uncalibratedflatplane_2, Origin=move.Geometry)
pl = ClusterOutput(pl_origin)

# ==== cluster GetGHFilepath
get_gh_filepath = GhPythonScript()  # -> out, filepath, filedir
# ---------- get_gh_filepath: Python ----------
import os


thisdoc = ghenv.Component.OnPingDocument()

while thisdoc.FilePath is None:
    #we are inside a cluster
    thisdoc = thisdoc.Owner.OwnerDocument()

filepath = thisdoc.FilePath
filedir = os.path.dirname(filepath)
# ---------- end get_gh_filepath ----------
filedir = ClusterOutput(get_gh_filepath.filedir)
filepath = ClusterOutput(get_gh_filepath.filepath)

# ==== cluster DEserializeData
jsondump = ClusterInput()
b64dump = ClusterInput()
or = ClusterInput()
or_2 = Data(or)
python = GhPythonScript(jsondump=jsondump, b64dump=b64dump)  # -> out, keys, vals
# ---------- python: Python ----------
import ghpythonlib.treehelpers as th
import json
import base64


thisjsondump = jsondump
if(b64dump):
    thisjsondump = base64.b64decode(b64dump)

d = json.loads(thisjsondump)
keys = th.list_to_tree(d["keys"])
vals = th.list_to_tree(d["vals"])
# ---------- end python ----------
vals = ClusterOutput(python.vals)
keys = ClusterOutput(python.keys)

# ==== cluster CalibrationWithMMV
mmv = ClusterInput()
pts = ClusterInput()
python = GhPythonScript(pts=pts, MMV=mmv)  # -> out, xs, ys, respt; inputs pts: list of Point3d, MMV: list
# ---------- python: Python ----------
from itertools import product

 
 
def multiply(matr_a, matr_b):
    """Return product of an MxP matrix A with an PxN matrix B."""
    cols, rows = len(matr_b[0]), len(matr_b)
    resRows = xrange(len(matr_a))
    rMatrix = [[0] * cols for _ in resRows]
    for idx in resRows:
        for j, k in product(xrange(cols), xrange(rows)):
            rMatrix[idx][j] += matr_a[idx][k] * matr_b[k][j]
    return rMatrix


xs = []
ys = []
for pt in pts:
    d = [[pt.X, pt.Y, 1]]
    MM = [[MMV[0], MMV[1], MMV[2]], [MMV[3], MMV[4], MMV[5]], [MMV[6], MMV[7], MMV[8]]]
    res = multiply(d, MM)[0]
    x = res[0] / res[2]
    y = res[1] / res[2]
    
    xs.append(x)
    ys.append(y)
    respt = (x, y, 0)
# ---------- end python ----------
pt = ConstructPoint(XCoordinate=python.xs, YCoordinate=python.ys, ZCoordinate=0)
topoint = ClusterOutput(pt)
