# Grasshopper definition Paperhopper_2_PLAY_TEMPLATE.gh (Grasshopper 1.0.7)
# plug-ins: InteracTool, Human, gHowl, LunchBox, Kangaroo2 Components, Telepathy

# Paperhopper_2_PLAY_TEMPLATE
# PaperHopper
# github.com/dantaeyoung/paperhopper
# -- CALIBRATION:
# 
# You must run this file after calibration!
# 
# If you haven't calibrated, close this file, then open
# 'Paperhopper_1_CALIBRATION.gh'.
# 
# If you have calibrated: Great! Save this file as a new file, then start playing.
# 
# -- PLUGINS:
# 
# This file requires several crucial plugins:
# - Human
# - gHowl
# - Lunchbox
# - Telepathy
# - Bengesht
# If you see errors, then load the plugins into Grasshopper, then close without saving and reopen this file.
# The plugins are conveniently collected in the gh_plugins folder.
# Dan Taeyoung / @dantaeyoung
# Receive and calibrate data from Reactivision based on `calibration.xml`
# If this doesn't work, follow these instructions:
listentocalibration_py = BooleanToggle(True)
update_calibration_data = Button()
filter = StreamFilter(Gate=listentocalibration_py, Stream1="3334")
gs_loadcalibrationdata = GSLoadCalibrationData(update=update_calibration_data)  # -> calibrationmmv, calibrationadjustment, playspacerectangle
udp = UDPReceiver(Port=filter, Pattern="999")  # -> Info, Data
turn_on_green_detection_circles = BooleanToggle(True)
# SETUP
parsecalibrateddata = ParseCalibratedData(calibrateddata=udp.Data)  # -> calibratedids_2, calibratedanglesfrom0to1_2, calibratedplanes_2, allcalibrateddata_2
show_playspace_rectangle = BooleanToggle(False)
detectioncircleradius = RemoteSender(Slider(10, range=0..100))
detectioncirclecolor = RemoteSender(ColourSwatch(SwatchColor=RGB(34, 97, 7)))
playspacerectangle = Geometry(gs_loadcalibrationdata.playspacerectangle)
detectioncircleradius_2 = RemoteReceiver(detectioncircleradius)
detectioncirclecolor_2 = RemoteReceiver(detectioncirclecolor)
playspacerectangle_2 = RemoteSender(playspacerectangle)
playspacerectangle_3 = RemoteReceiver(playspacerectangle_2)
filter_2 = StreamFilter(Gate=show_playspace_rectangle, Stream1=playspacerectangle_3)
# v0.2
calibratedids = RemoteSender(parsecalibrateddata.calibratedids_2)
calibratedanglesfrom0to1 = RemoteSender(parsecalibrateddata.calibratedanglesfrom0to1_2)
calibratedanglesfrom0to1_2 = RemoteReceiver(calibratedanglesfrom0to1)
calibratedplanes = RemoteSender(parsecalibrateddata.calibratedplanes_2)

calibratedplanes_2 = RemoteReceiver(calibratedplanes)
turn_on_blobs = BooleanToggle(True)
stream_filter = StreamFilter(Gate=turn_on_blobs, Stream1=calibratedplanes_2)
number_slider = Slider(0.003, range=0..0.003)
delaunay_edges = DelaunayEdges(Points=flatten(stream_filter), Plane=PlaneXY(0, 0, 0))  # -> Connectivity, Edges
metaball_t = MetaBallT(Points=flatten(stream_filter), Plane=PlaneXY(0, 0, 0), Threshold=Slider(0.0073, range=0..0.01))
length = Length(Curve=metaball_t)
# DEBUG
trim_with_regions = TrimWithRegions(Curve=delaunay_edges.Edges, Regions=metaball_t)  # -> Inside, Outside
geometry = Geometry(trim_with_regions.Outside)
gradient = Gradient(
    LowerLimit=0,
    UpperLimit=Slider(1867, range=0..100000),
    Parameter=length,
    stops=[0: RGB(243, 57, 0), 0.1: RGB(236, 27, 60), 0.2: RGB(210, 0, 118), 0.3: RGB(103, 0, 120), 0.4: RGB(39, 72, 161), 0.5: RGB(1, 192, 229), 0.6: RGB(18, 178, 90), 0.7: RGB(79, 186, 8), 0.8: RGB(220, 237, 32), 0.9: RGB(247, 159, 20), 1: RGB(243, 57, 0)])
custom_preview_lineweights = CustomPreviewLineweights(
    Geometry=geometry,
    Shader=ColourSwatch(SwatchColor=RGB(189, 111, 111)),
    Thickness=Slider(10, range=0..10),
    Absolute=False)
custom_preview_lineweights_2 = CustomPreviewLineweights(Geometry=metaball_t, Shader=gradient, Thickness=Slider(10, range=0..10), Absolute=False)

calibratedplanes_3 = RemoteReceiver(calibratedplanes)
filter_3 = StreamFilter(Gate=turn_on_green_detection_circles, Stream1=calibratedplanes_3)
allcalibrateddata = RemoteSender(parsecalibrateddata.allcalibrateddata_2)
circle = Circle(Plane=filter_3, Radius=detectioncircleradius_2)
custom_preview_lineweights_3 = CustomPreviewLineweights(Geometry=filter_2, Shader=ColourSwatch(SwatchColor=RGB(148, 148, 148)), Thickness=Slider(2, range=0..10), Absolute=False)
multiplication = Multiplication(A=calibratedanglesfrom0to1_2, B=Slider(360, range=0..1000))

turn_on_debug = BooleanToggle(False)
calibratedplanes_4 = RemoteReceiver(calibratedplanes)
stream_filter_2 = StreamFilter(Gate=turn_on_debug, Stream1=calibratedplanes_4)
projectionscale_rhinooverirl = RemoteReceiver()
md_slider = MDSlider(
    SliderMode=0,
    slider_value=Point(0.9360868078, 0.6700220353, 0.5),
    x_domain=Domain(-30, 30),
    y_domain=Domain(-30, 30),
    z_domain=Domain(0, 1))
deconstruct_plane = DeconstructPlane(Plane=stream_filter_2)  # -> Origin, XAxis, YAxis, ZAxis
number_slider_2 = Slider(55, range=0..100)
calibratedids_2 = RemoteReceiver(calibratedids)
move = Move(Geometry=deconstruct_plane.Origin, Motion=md_slider)  # -> Geometry, Transform
deconstruct = Deconstruct(Point=deconstruct_plane.Origin)  # -> XComponent, YComponent, ZComponent
multiplication_2 = Multiplication(A=projectionscale_rhinooverirl, B=Slider(0.7, range=0..4))
line_sdl = LineSDL(Start=deconstruct_plane.Origin, Direction=deconstruct_plane.YAxis, Length=number_slider_2)
line_sdl_2 = LineSDL(Start=deconstruct_plane.Origin, Direction=deconstruct_plane.XAxis, Length=number_slider_2)
concatenate = Concatenate(
    FragmentH="ID: ",
    FragmentG=calibratedids_2,
    FragmentF="x: ",
    FragmentA=deconstruct.XComponent,
    FragmentB=", y: ",
    FragmentC=deconstruct.YComponent,
    FragmentD="rot: ",
    FragmentE=multiplication)
gradient_2 = Gradient(
    LowerLimit="0",
    UpperLimit="360",
    Parameter=multiplication,
    stops=[0: RGB(243, 57, 0), 0.1: RGB(236, 27, 60), 0.2: RGB(210, 0, 118), 0.3: RGB(103, 0, 120), 0.4: RGB(39, 72, 161), 0.5: RGB(1, 192, 229), 0.6: RGB(18, 178, 90), 0.7: RGB(79, 186, 8), 0.8: RGB(220, 237, 32), 0.9: RGB(247, 159, 20), 1: RGB(243, 57, 0)])
geometry_2 = Geometry([line_sdl_2, line_sdl])
# Undo / Redo
text_tag_3d = TextTag3D(Location=move.Geometry, Text=concatenate, Size=Slider(6, range=0..100), Colour=gradient_2, Justification=7)
custom_preview_lineweights_4 = CustomPreviewLineweights(
    Geometry=geometry_2,
    Shader={diffuse=RGB(255, 105, 180), emission=RGB(76, 32, 54), shine=0.5, specular=RGB(255, 255, 255), transparency=0},
    Thickness=Slider(6, range=0..10),
    Absolute=False)

custom_preview = CustomPreview(Geometry=circle, Material=detectioncirclecolor_2)
panel = Panel(allcalibrateddata)
# Use this component to find tags based on tag ID!
panel_2 = Panel("ws://echo.websocket.org")  # disabled
button = Button()  # disabled
# PLAY
toggle = BooleanToggle(False)  # disabled
panel_3 = Panel("44444")  # disabled
websocket_client_start = WebsocketClientStart(Address=panel_2, InitalMessage="Hello World", Reset=button)  # disabled
calibratedanglesfrom0to1_3 = RemoteReceiver(calibratedanglesfrom0to1)
httpin = HttpInput(Start=toggle, Prefix="http://localhost:8080/bengesht/")  # -> Keys, Values, ListenerObject; disabled
calibratedplanes_5 = RemoteReceiver(calibratedplanes)
calibratedids_3 = RemoteReceiver(calibratedids)
websocket_client_sender = WebsocketClientSender(WebsocketObjects=websocket_client_start, Message=panel_3)  # disabled
websocket_client_receiver = WebsocketClientReceiver(WebsocketObjects=websocket_client_start, AutoUpdate=True)  # -> Message, Status; disabled
httpout = HttpOutput(Response=Slider(6143, range=0..10000), HttpListener=httpin.ListenerObject)  # disabled
panel_4 = Panel(websocket_client_receiver.Message)  # disabled
datatojson = DataToJson(calibratedids=calibratedids_3, calibratedanglesfrom0to1=calibratedanglesfrom0to1_3, calibratedplanes=calibratedplanes_5)
panel_5 = Panel(datatojson)
allcalibrateddata_2 = RemoteReceiver(allcalibrateddata)
ph_find_tags_v6 = PHFindTagsV6(tag_id="78", allcalibrateddata=allcalibrateddata_2)  # -> tag_id_exists_2, calibrated_planes_2, anglefrom0to1_2
allcalibrateddata_3 = RemoteReceiver(allcalibrateddata)
panel_6 = Panel("""3
9
145""")
# Find tags based on tag ID
panel_7 = Panel("145")
allcalibrateddata_4 = RemoteReceiver(allcalibrateddata)
panel_8 = Panel(ph_find_tags_v6.calibrated_planes_2)
panel_9 = Panel(ph_find_tags_v6.tag_id_exists_2)
panel_10 = Panel(ph_find_tags_v6.anglefrom0to1_2)
ph_find_tags_v6_2 = PHFindTagsV6(tag_id=panel_6, allcalibrateddata=allcalibrateddata_4)  # -> tag_id_exists_2, calibrated_planes_2, anglefrom0to1_2
ph_find_tags_v6_3 = PHFindTagsV6(tag_id=panel_7, allcalibrateddata=allcalibrateddata_3)  # -> tag_id_exists_2, calibrated_planes_2, anglefrom0to1_2
md_slider_2 = MDSlider(
    SliderMode=0,
    slider_value=Point(0.1661887527, 0.5650404023, 0.5),
    x_domain=Domain(-100, 100),
    y_domain=Domain(-100, 100),
    z_domain=Domain(0, 1))
panel_11 = Panel(ph_find_tags_v6_2.tag_id_exists_2)
panel_12 = Panel(ph_find_tags_v6_2.calibrated_planes_2)
panel_13 = Panel(ph_find_tags_v6_3.tag_id_exists_2)
panel_14 = Panel(ph_find_tags_v6_3.calibrated_planes_2)
panel_15 = Panel(ph_find_tags_v6_2.anglefrom0to1_2)
panel_16 = Panel(ph_find_tags_v6_3.anglefrom0to1_2)
rotate_plane = RotatePlane(Plane=ph_find_tags_v6.calibrated_planes_2, Angle="Pi")
moveplane = MovePlane(plane=rotate_plane, vector=md_slider_2)
detectioncirclecolor_3 = RemoteReceiver(detectioncirclecolor)
# DRWG
colour_swatch = ColourSwatch(SwatchColor=RGB(255, 255, 255))
keyboard_event = KeyBoardEvent(Start=Slider(4, range=0..10))  # -> Current, Pressed, Toggled
text_tag_3d_2 = TextTag3D(Location=moveplane, Text="Keyboard", Size=Slider(10, range=0..10), Colour=colour_swatch, Justification=5)
panel_17 = Panel(keyboard_event.Pressed)
allcalibrateddata_5 = RemoteReceiver(allcalibrateddata)
md_slider_3 = MDSlider(
    SliderMode=0,
    slider_value=Point(0.5956845167, 0.6831815766, 0.5),
    x_domain=Domain(0, 1),
    y_domain=Domain(0, 1),
    z_domain=Domain(0, 1))
playspacerectangle_4 = RemoteReceiver(playspacerectangle_2)
ph_find_tags_v6_4 = PHFindTagsV6(tag_id="5", allcalibrateddata=allcalibrateddata_5)  # -> tag_id_exists_2, calibrated_planes_2, anglefrom0to1_2
tag_is_visible = BooleanToggle(False)
panel_18 = Panel(ph_find_tags_v6_4.tag_id_exists_2)
panel_19 = Panel(ph_find_tags_v6_4.calibrated_planes_2)
prototype_tags = PrototypeTAGS(surface=playspacerectangle_4, boolean=tag_is_visible, point=md_slider_3, anglefrom0to1=Slider(0.83, range=0..1))  # -> tag_id_exists_2, calibrated_planes_2, anglefrom0to1_4
panel_20 = Panel(ph_find_tags_v6_4.anglefrom0to1_2)
anglefrom0to1 = Number(prototype_tags.anglefrom0to1_4)
calibrated_planes = Plane(prototype_tags.calibrated_planes_2)
tag_id_exists = Boolean(prototype_tags.tag_id_exists_2)
allcalibrateddata_6 = RemoteReceiver(allcalibrateddata)
ph_find_tags_v6_5 = PHFindTagsV6(tag_id="120", allcalibrateddata=allcalibrateddata_6)  # -> tag_id_exists_2, calibrated_planes_2, anglefrom0to1_2
panel_21 = Panel("_undo")
boolean_toggle = BooleanToggle(False)
rhino_command = RhinoCommand(SendCommandToggle=ph_find_tags_v6_5.tag_id_exists_2, CommandString="_SelAll _Enter _Delete _Enter")
allcalibrateddata_7 = RemoteReceiver(allcalibrateddata)
allcalibrateddata_8 = RemoteReceiver(allcalibrateddata)
allcalibrateddata_9 = RemoteReceiver(allcalibrateddata)
allcalibrateddata_10 = RemoteReceiver(allcalibrateddata)
allcalibrateddata_11 = RemoteReceiver(allcalibrateddata)
commgfa = Panel("""182
156
157
166
181
191""")
tall_timber = Panel("189")
solar = Panel("158")
resgfa = Panel("""162
186
167
164
161
183""")
parks = Panel("""190
165
188
159
185""")
ph_find_tags_v6_6 = PHFindTagsV6(tag_id=tall_timber, allcalibrateddata=allcalibrateddata_7)  # -> tag_id_exists_2, calibrated_planes_2, anglefrom0to1_2
ph_find_tags_v6_7 = PHFindTagsV6(tag_id=resgfa, allcalibrateddata=allcalibrateddata_8)  # -> tag_id_exists_2, calibrated_planes_2, anglefrom0to1_2
ph_find_tags_v6_8 = PHFindTagsV6(tag_id=solar, allcalibrateddata=allcalibrateddata_9)  # -> tag_id_exists_2, calibrated_planes_2, anglefrom0to1_2
ph_find_tags_v6_9 = PHFindTagsV6(tag_id=commgfa, allcalibrateddata=allcalibrateddata_10)  # -> tag_id_exists_2, calibrated_planes_2, anglefrom0to1_2
ph_find_tags_v6_10 = PHFindTagsV6(tag_id=parks, allcalibrateddata=allcalibrateddata_11)  # -> tag_id_exists_2, calibrated_planes_2, anglefrom0to1_2
panel_22 = Panel(ph_find_tags_v6_6.tag_id_exists_2)
panel_23 = Panel(ph_find_tags_v6_6.calibrated_planes_2)
panel_24 = Panel(ph_find_tags_v6_6.anglefrom0to1_2)
panel_25 = Panel(ph_find_tags_v6_7.tag_id_exists_2)
panel_26 = Panel(ph_find_tags_v6_7.calibrated_planes_2)
panel_27 = Panel(ph_find_tags_v6_8.tag_id_exists_2)
panel_28 = Panel(ph_find_tags_v6_8.calibrated_planes_2)
panel_29 = Panel(ph_find_tags_v6_9.tag_id_exists_2)
panel_30 = Panel(ph_find_tags_v6_9.calibrated_planes_2)
panel_31 = Panel(ph_find_tags_v6_10.tag_id_exists_2)
panel_32 = Panel(ph_find_tags_v6_7.anglefrom0to1_2)
panel_33 = Panel(ph_find_tags_v6_10.calibrated_planes_2)
panel_34 = Panel(ph_find_tags_v6_8.anglefrom0to1_2)
panel_35 = Panel(ph_find_tags_v6_9.anglefrom0to1_2)
panel_36 = Panel(ph_find_tags_v6_10.anglefrom0to1_2)
input_resgfa = Slider(4, range=0..10)
ma = MassAddition(Input=ph_find_tags_v6_10.tag_id_exists_2)  # -> Result, PartialResults
ma_2 = MassAddition(Input=ph_find_tags_v6_9.tag_id_exists_2)  # -> Result, PartialResults
ma_3 = MassAddition(Input=ph_find_tags_v6_7.tag_id_exists_2)  # -> Result, PartialResults
int = Integer(ph_find_tags_v6_7.tag_id_exists_2)
input_commgfa = Slider(2, range=0..10)
input_parks = Slider(4, range=0..10)
constant_cityarea = Slider(6, range=0..10)
input_tall_timber = BooleanToggle(True)
input_solar = BooleanToggle(True)
input_resgfa_2 = RemoteSender(ma_3.Result)
input_commgfa_2 = RemoteSender(ma_2.Result)
constant_cityarea_2 = RemoteSender(constant_cityarea)
input_parks_2 = RemoteSender(ma.Result)
input_tall_timber_2 = RemoteSender(ph_find_tags_v6_6.tag_id_exists_2)
input_solar_2 = RemoteSender(ph_find_tags_v6_8.tag_id_exists_2)
# res gfa
# comm gfa
# park
# solar
# tall timber
panel_37 = Panel(ma_3.Result)
panel_38 = Panel("""cost
$
qol
sustainability""")
panel_39 = Panel("""solar,	parks,	building height,	tall timber,	quality of life,	cost,	sustainability
1,	1,	0,	0,	1,	1,	1
0,	1,	0,	0,	1,	1,	1
0,	0,	1,	0,	-1,	1,	0
0,	0,	-1,	1,	0,	1,	1
0,	0,	0,	0,	1,	0,	0
0,	0,	0,	0,	0,	1,	0
0,	0,	0,	0,	0,	0,	1""")
# ratio of parks to bldg
input_parks_3 = RemoteReceiver(input_parks_2)
merge = Merge(Data1="0", Data2=Slider(33, range=0..100), Data3=Slider(67, range=0..100), Data4="100")
merge_2 = Merge(Data1=Slider(-1, range=-5..10), Data2=Slider(2, range=-5..10), Data3=Slider(5, range=-5..10))
consec = ConsecutiveDomains(Numbers=merge, Additive=False)
input_commgfa_3 = RemoteReceiver(input_commgfa_2)
input_parks_4 = RemoteReceiver(input_parks_2)
# Building Footprint
constant_cityarea_3 = RemoteReceiver(constant_cityarea_2)
input_parks_5 = RemoteReceiver(input_parks_2)
input_resgfa_3 = RemoteReceiver(input_resgfa_2)
# Revenue
number_slider_3 = Slider(2, range=0..10)
# Sustainability
input_solar_3 = RemoteReceiver(input_solar_2)
merge_3 = Merge(Data1="0", Data2=Slider(33, range=0..100), Data3=Slider(67, range=0..100), Data4="100")
input_tall_timber_3 = RemoteReceiver(input_tall_timber_2)
input_parks_6 = RemoteReceiver(input_parks_2)
merge_4 = Merge(Data1=Slider(2, range=-5..10), Data2=Slider(10, range=-5..10), Data3=Slider(3, range=-5..10))
consec_2 = ConsecutiveDomains(Numbers=merge_3, Additive=False)
multiplication_3 = Multiplication(A=input_parks_5, B="1")
addition = Addition(A=input_resgfa_3, B=input_commgfa_3)
subtraction = Subtraction(A=constant_cityarea_3, B=input_parks_4)
input_tall_timber_4 = RemoteReceiver(input_tall_timber_2)
max = Maximum(A=subtraction, B="0")
division = Division(A=addition, B=max)
merge_5 = Merge(
    Data1=Slider(0.5504, range=0..1),
    Data2=Slider(0.6237, range=0..1),
    Data3=Slider(0.6217, range=0..1),
    Data4=Toggle(True),
    Data5=Slider(0, range=0..1),
    Data6=Slider(0.2733, range=0..1),
    Data7=Slider(0.6388, range=0..1))
output_parkfootprint = RemoteSender(input_parks_6)
output_parkfootprint_2 = RemoteReceiver(output_parkfootprint)
split = SplitList(List=panel_39, Index="1")  # -> ListA, ListB
multiplication_4 = Multiplication(A=division, B="1")
number_slider_4 = Slider(0.66, range=0..1)
output_buildingfootprint = RemoteSender(max)
output_buildingfootprint_2 = RemoteReceiver(output_buildingfootprint)
panel_40 = Panel(output_buildingfootprint_2)
output_buildingfootprint_3 = RemoteReceiver(output_buildingfootprint)
multiplication_5 = Multiplication(A=input_solar_3, B=output_buildingfootprint_3)
solar_output = Panel(multiplication_5)
split_2 = TextSplit(Text=split.ListB, Separators=",")  # -> simplify(graft(Result))
input_commgfa_4 = RemoteReceiver(input_commgfa_2)
num = Number(simplify(graft(merge_5)))
input_resgfa_4 = RemoteReceiver(input_resgfa_2)
trim = TrimTree(Tree=split_2, Depth=1)
multiplication_6 = Multiplication(A=multiplication_4, B=number_slider_4)
split_3 = TextSplit(Text=split.ListA, Separators=",")  # -> simplify(Result)
filter_4 = StreamFilter(Gate=input_tall_timber_4, Stream0=multiplication_4, Stream1=multiplication_6)
output_buildingheight = RemoteSender(filter_4)
output_buildingheight_2 = RemoteReceiver(output_buildingheight)
panel_41 = Panel(output_buildingheight_2)
multiplication_7 = Multiplication(A=input_resgfa_4, B=number_slider_4)
multiplication_8 = Multiplication(A=input_commgfa_4, B=number_slider_4)
headers = Number(split_3)
data = Number(trim)
multiplication_9 = Multiplication(A=data, B=num)
headers_2 = Text(split_3)
filter_5 = StreamFilter(Gate=input_tall_timber_4, Stream0=input_resgfa_4, Stream1=multiplication_7)
flip = FlipMatrix(Data=multiplication_9)
filter_6 = StreamFilter(Gate=input_tall_timber_4, Stream0=input_commgfa_4, Stream1=multiplication_8)
output_commgfa = RemoteSender(filter_6)
output_commgfa_2 = RemoteReceiver(output_commgfa)
output_commgfa_3 = RemoteReceiver(output_commgfa)
output_commgfa_4 = RemoteReceiver(output_commgfa)
output_commgfa_5 = RemoteReceiver(output_commgfa)
output_commgfa_6 = RemoteReceiver(output_commgfa)
output_commgfa_7 = RemoteReceiver(output_commgfa)
output_commgfa_8 = RemoteReceiver(output_commgfa)
multiplication_10 = Multiplication(A="1", B=output_commgfa_6, C=number_slider_3)
multiplication_11 = Multiplication(A=output_commgfa_7, B="1", C=Slider(20, range=0..100))
multiplication_12 = Multiplication(A="1", B=output_commgfa_5, C=Slider(3, range=0..10))
output_resgfa = RemoteSender(filter_5)
output_resgfa_2 = RemoteReceiver(output_resgfa)
output_resgfa_3 = RemoteReceiver(output_resgfa)
# ratio of res to comm
addition_2 = Addition(A=output_resgfa_2, B=output_commgfa_2)
output_resgfa_4 = RemoteReceiver(output_resgfa)
# Quality of Life
division_2 = Division(A=output_resgfa_2, B=addition_2)
output_resgfa_5 = RemoteReceiver(output_resgfa)
# Cost
output_resgfa_6 = RemoteReceiver(output_resgfa)
multiplication_13 = Multiplication(A=division_2, B="100")
addition_3 = Addition(A=input_parks_3, B=output_resgfa_3, C=output_commgfa_3)
output_resgfa_7 = RemoteReceiver(output_resgfa)
inc = Includes(Value=multiplication_13, Domain=consec)  # -> Includes, Deviation
division_3 = Division(A=input_parks_3, B=addition_3)
dispatch = Dispatch(List=merge_2, DispatchPattern=inc.Includes)  # -> ListA, ListB
addition_4 = Addition(A=output_resgfa_4, B=output_commgfa_4)
multiplication_14 = Multiplication(A=output_resgfa_6, B="1")
multiplication_15 = Multiplication(A=division_3, B="100")
division_4 = Division(A=addition_4, B=Slider(4, range=0..10))
multiplication_16 = Multiplication(A=output_resgfa_5, B="1")
inc_2 = Includes(Value=multiplication_15, Domain=consec_2)  # -> Includes, Deviation
filter_7 = StreamFilter(Gate=input_tall_timber_3, Stream1=division_4)
addition_5 = Addition(A=multiplication_14, B=multiplication_10)
dispatch_2 = Dispatch(List=merge_4, DispatchPattern=inc_2.Includes)  # -> ListA, ListB
panel_42 = Panel(division_4)
addition_6 = Addition(A=multiplication_5, B=filter_7)
addition_7 = Addition(A=multiplication_16, B=multiplication_12, C=multiplication_3, D=multiplication_11)
output_cost = RemoteSender(addition_5)
output_cost_2 = RemoteReceiver(output_cost)
panel_43 = Panel(output_cost_2)
output_sustainability = RemoteSender(addition_6)
output_sustainability_2 = RemoteReceiver(output_sustainability)
panel_44 = Panel(output_sustainability_2)
addition_8 = Addition(A=dispatch.ListA, B=dispatch_2.ListA)
division_5 = Division(A=addition_7, B=Slider(9, range=0..10))
output_qol = RemoteSender(addition_8)
output_qol_2 = RemoteReceiver(output_qol)
panel_45 = Panel(output_qol_2)
panel_46 = Panel(addition_6)
output_revenue = RemoteSender(division_5)
output_revenue_2 = RemoteReceiver(output_revenue)
panel_47 = Panel(output_revenue_2)
panel_48 = Panel(headers_2)
ma_4 = MassAddition(Input=flip)  # -> flatten(Result), PartialResults
geo = Geometry(<curve referenced from the Rhino model>)
output_parkfootprint_3 = RemoteReceiver(output_parkfootprint)  # disabled
output_sustainability_3 = RemoteReceiver(output_sustainability)  # disabled
output_revenue_3 = RemoteReceiver(output_revenue)  # disabled
output_cost_3 = RemoteReceiver(output_cost)  # disabled
output_qol_3 = RemoteReceiver(output_qol)  # disabled
divide = DivideCurve(Curve=geo, Count=10, Kinks=False)  # -> Points, Tangents, Parameters
fline = FitLine(Points=divide.Points)
divide_2 = DivideCurve(Curve=fline, Count=Slider(10, range=0..10), Kinks=False)  # -> Points, Tangents, Parameters
geo_2 = Geometry(<curve referenced from the Rhino model>)  # disabled
Z = UnitZ(Factor=1)
Z_2 = UnitZ(Factor=1)  # disabled
boundary = BoundarySurfaces(Edges=geo_2)  # disabled
panel_49 = Panel("1")  # disabled
vrot = Rotate(Vector=divide_2.Tangents, Axis=Z, Angle="Pi / 2")
addition_9 = Addition(A=panel_49, B=output_parkfootprint_3)  # disabled
output_buildingfootprint_4 = RemoteReceiver(output_buildingfootprint)  # disabled
extr = Extrude(Base=boundary, Direction=Z_2)  # disabled
rev = Reverse(Vector=vrot)
pop2d = Populate2D(Region=geo_2, Count=addition_9, Seed=1)  # disabled
panel_50 = Panel("1")  # disabled
amp = Amplitude(Vector=rev, Amplitude=Slider(28, range=0..1000))
number_slider_5 = Slider(2, range=0..10)  # disabled
number_slider_6 = Slider(10, range=0..10)  # disabled
mesh = MeshBrep(
    Brep=extr,
    Settings={GridMaxCount=0, GridMinCount=16, JaggedSeams=False, MaxEdgeLength=0, MinEdgeLength=0.0001, MinTolerance=0, Refine=True, RefineAngle=0, RelativeTolerance=0.65, SimplePlanes=True, Tolerance=0})  # disabled
move_2 = Move(Geometry=divide_2.Points, Motion=amp)  # -> Geometry, Transform
area = Area(Geometry=geo_2)  # -> Area, Centroid; disabled
split_4 = SplitList(List=pop2d, Index=panel_50)  # -> ListA, ListB; disabled
number_slider_7 = Slider(1000, range=0..1000)  # disabled
crossref = CrossReference(ListA=pop2d, ListB=pop2d, CrossMode=5)  # -> ListA, ListB; disabled
line = LineSDL(Start=move_2.Geometry, Direction=vrot, Length=Slider(42, range=0..1000))
lng = ListLength(List=split_4.ListB)  # disabled
number_slider_8 = Slider(0.224, range=0..1)  # disabled
number_slider_9 = Slider(0, range=0..1)  # disabled
ln = Line(StartPoint=area.Centroid, EndPoint=pop2d)  # disabled
ln_2 = Line(StartPoint=crossref.ListA, EndPoint=crossref.ListB)  # disabled
show = Show(G=pop2d)  # disabled
repeat = RepeatData(Data=number_slider_5, Length=lng)  # disabled
merge_6 = Merge(Data1=flatten(output_buildingfootprint_4), Data2=flatten(repeat))  # disabled
sc = SphereCollide(Points=pop2d, Radius=merge_6, Strength=number_slider_6)  # disabled
onmesh = OnMesh(Points=pop2d, Mesh=mesh, Strength=number_slider_7)  # disabled
length_line = LengthLine(Line=ln, Length=number_slider_9, Strength=number_slider_8)  # disabled
entwine = Entwine(Branch00=onmesh, Branch01=sc, Branch02=show, Branch03=length_line, FlattenInputs=True)  # disabled
button_2 = Button()  # disabled
panel_51 = Panel(merge_6)  # disabled
toggle_2 = BooleanToggle(True)  # disabled
genes = GenePool(Decimals=4, Maximum=1, Minimum=0, Value=[0.7385, 0.3864, 1, 0.1825, 0.2288, 0.7735, 0.9417, 0.4863])  # disabled
geo_3 = Geometry(<curve referenced from the Rhino model>)  # disabled
solver = Solver(GoalObjects=entwine, Reset=button_2, Threshold=1e-15, Tolerance=0.01, On=toggle_2)  # -> I, V, O; disabled
output_buildingfootprint_5 = RemoteReceiver(output_buildingfootprint)  # disabled
output_buildingheight_3 = RemoteReceiver(output_buildingheight)  # disabled
dam = DataDam(DataA=solver.O, BufferDelay=2500000, BufferMode=2)  # disabled
bang = ExplodeTree(Data=dam)  # -> Branch0, Branch1, Branch2, Branch3; disabled
eval = EvaluateLength(Curve=geo_3, Length=genes, Normalized=True)  # -> Point, Tangent, Parameter; disabled
panel_52 = Panel("1")  # disabled
pipeline = GeometryPipeline(
    GroupByLayer=False,
    GroupByType=False,
    IncludeHidden=True,
    IncludeLocked=True,
    LayerFilter="land",
    NameFilter="*",
    SublayerFiltering=True,
    TypeFilter=4)  # disabled
panel_53 = Panel("2")  # disabled
geo_4 = Geometry(bang.Branch2)  # disabled
split_5 = SplitList(List=geo_4, Index=panel_52)  # -> ListA, ListB; disabled
panel_54 = Panel(bang.Branch2)  # disabled
partition = PartitionList(List=eval.Point, Size=panel_53)  # disabled
boundary_2 = BoundarySurfaces(Edges=pipeline)  # disabled
item = ListItem(List=partition, Index=0, Wrap=True)  # -> Item, Item1; disabled
pipeline_2 = GeometryPipeline(
    GroupByLayer=False,
    GroupByType=False,
    IncludeHidden=True,
    IncludeLocked=True,
    LayerFilter="streets",
    NameFilter="*",
    SublayerFiltering=True,
    TypeFilter=4)
cir = Circle(Plane=split_5.ListB, Radius=number_slider_5)  # disabled
pipeline_3 = GeometryPipeline(
    GroupByLayer=False,
    GroupByType=False,
    IncludeHidden=True,
    IncludeLocked=True,
    LayerFilter="land",
    NameFilter="*",
    SublayerFiltering=True,
    TypeFilter=4)
ln_3 = Line(StartPoint=item.Item, EndPoint=item.Item1)  # disabled
buildingmaker = BuildingMaker(P=split_5.ListA, R=output_buildingfootprint_5, F=output_buildingheight_3)  # -> B, R_2; disabled
trim_2 = TrimWithRegion(Curve=pipeline_2, Region=pipeline_3)  # -> Inside, Outside
panel_55 = Panel("""2
3""")
number_slider_10 = Slider(-0.2847, range=-1..0)  # disabled
srfsplit = SurfaceSplit(Surface=boundary_2, Curves=ln_3)  # disabled
swatch = ColourSwatch(SwatchColor=RGB(150, 236, 255))  # disabled
merge_7 = Merge(Data1=Slider(0.152, range=0..0.5), Data2=Slider(0.3935, range=0..0.5))
swatch_2 = ColourSwatch(SwatchColor=RGBA(212, 49, 49, 0))  # disabled
boundary_3 = BoundarySurfaces(Edges=cir)  # disabled
boundary_4 = BoundarySurfaces(Edges=pipeline_3)
swatch_3 = ColourSwatch(SwatchColor=RGB(38, 255, 18))  # disabled
preview = CustomPreview(Geometry=buildingmaker.B, Material=swatch_2)  # disabled
preview_2 = CustomPreview(Geometry=buildingmaker.R_2, Material=swatch)  # disabled
dash = DashPattern(Curve=trim_2.Inside, Pattern=merge_7)  # -> Dashes, Gaps
preview_3 = CustomPreview(Geometry=boundary_3, Material=swatch_3)  # disabled
cluster = Cluster_2(geo=srfsplit, num=number_slider_10)  # disabled
srfsplit_2 = SurfaceSplit(Surface=boundary_4, Curves=pipeline_2)
preview_4 = CustomPreview(Geometry=boundary_4, Material=ColourSwatch(SwatchColor=RGB(255, 255, 255)))
item_2 = ListItem(List=cir, Index=0, Wrap=True)  # disabled
area_2 = Area(Geometry=cluster)  # -> flatten(Area), Centroid; disabled
previewlw = CustomPreviewLineweights(
    Geometry=dash.Dashes,
    Shader=ColourSwatch(SwatchColor=RGB(255, 255, 255)),
    Thickness=Slider(5, range=0..100),
    Absolute=False)
standarddeviation = StandardDeviation(data=area_2.Area)  # disabled
cluster_2 = Cluster_2(geo=srfsplit_2, num=Slider(-0.2847, range=-1..0))
galapagos = Galapagos()
preview_5 = CustomPreview(Geometry=boundary_4, Material=ColourSwatch(SwatchColor=RGB(82, 82, 82)))
divide_3 = DivideCurve(Curve=cluster_2, Count=10, Kinks=False)  # -> Points, Tangents, Parameters
panel_56 = Panel(standarddeviation)  # disabled
fline_2 = FitLine(Points=divide_3.Points)
divide_4 = DivideCurve(Curve=fline_2, Count=Slider(4, range=0..10), Kinks=False)  # -> Points, Tangents, Parameters
boundary_5 = BoundarySurfaces(Edges=cluster_2)
Z_3 = UnitZ(Factor=Slider(0.038, range=0..1))
extr_2 = Extrude(Base=boundary_5, Direction=Z_3)
preview_6 = CustomPreview(Geometry=extr_2, Material=ColourSwatch(SwatchColor=RGB(122, 122, 122)))
quadsub = SubdivideQuad(
    QuadSurface=boundary_5,
    Subdivide=Slider(2, range=0..10),
    Boolean1=Toggle(False),
    Boolean2=Toggle(False),
    Boolean3=Toggle(True),
    Boolean4=Toggle(True),
    Wires=True)  # -> QuadCellsA, QuadCellsB
output_buildingfootprint_6 = RemoteReceiver(output_buildingfootprint)
geo_5 = Geometry([quadsub.QuadCellsA, quadsub.QuadCellsB])
rint = RegionIntersection(CurvesA=geo_5, CurvesB=boundary_5)
area_3 = Area(Geometry=rint)  # -> simplify(Area), Centroid
output_parkfootprint_4 = RemoteReceiver(output_parkfootprint)
sort = SortList(Keys=area_3.Area, ValuesA=rint)  # -> Keys, ValuesA
number_slider_11 = Slider(9, range=0..10)
addition_10 = Addition(A=output_buildingfootprint_6, B=Slider(-1, range=-4..0))
panel_57 = Panel(addition_10)
ma_5 = MassAddition(Input=sort.Keys)  # -> Result, PartialResults
output_buildingheight_4 = RemoteReceiver(output_buildingheight)
multiplication_17 = Multiplication(A=addition_10, B=Slider(2.5, range=0.5..3))
addition_11 = Addition(A=multiplication_17, B=Slider(1, range=0..10))
larger = LargerThan(FirstNumber=addition_11, SecondNumber=ma_5.PartialResults)  # -> LargerThan, OrEqualTo
panel_58 = Panel(output_buildingfootprint_6)
dispatch_3 = Dispatch(List=sort.ValuesA, DispatchPattern=larger.LargerThan)  # -> ListA, ListB
multiplication_18 = Multiplication(A=Slider(0.8, range=0..10), B=output_buildingheight_4)
geo_6 = Geometry(simplify(dispatch_3.ListA))
num_2 = Number(multiplication_18)
dom = ConstructDomain(DomainStart=Slider(0.653, range=0..1), DomainEnd=Slider(1, range=0..1))
lng_2 = ListLength(List=geo_6)
random = Random(Range=dom, Number=lng_2, Seed=num_2)
input_commgfa_5 = RemoteReceiver(input_commgfa_2)
input_resgfa_5 = RemoteReceiver(input_resgfa_2)
input_commgfa_6 = RemoteReceiver(input_commgfa_2)
multiplication_19 = Multiplication(A=random, B=num_2)
input_resgfa_6 = RemoteReceiver(input_resgfa_2)
addition_12 = Addition(A=input_resgfa_5, B=input_commgfa_5)
division_6 = Division(A=input_commgfa_6, B=addition_12)
multiplication_20 = Multiplication(A=multiplication_19, B=division_6)
Z_4 = UnitZ(Factor=multiplication_20)
runion = RegionUnion(Curves=geo_6)
division_7 = Division(A=input_resgfa_6, B=addition_12)
move_3 = Move(Geometry=geo_6, Motion=Z_4)  # -> Geometry, Transform
extr_3 = Extrude(Base=geo_6, Direction=Z_4)
multiplication_21 = Multiplication(A=multiplication_19, B=division_7)
cap = CapHoles(Brep=extr_3)
addition_13 = Addition(A=Slider(0.5, range=0..1), B=multiplication_21)
Z_5 = UnitZ(Factor=multiplication_21)
extr_4 = Extrude(Base=move_3.Geometry, Direction=Z_5)
preview_7 = CustomPreview(Geometry=cap, Material=ColourSwatch(SwatchColor=RGB(145, 181, 179)))
Z_6 = UnitZ(Factor=addition_13)
input_solar_4 = RemoteReceiver(input_solar_2)
cap_2 = CapHoles(Brep=extr_4)
area_4 = Area(Geometry=move_3.Geometry)  # -> Area, Centroid
move_4 = Move(Geometry=move_3.Geometry, Motion=Z_5)  # -> Geometry, Transform
geo_7 = Geometry(simplify(dispatch_3.ListB))
preview_8 = CustomPreview(Geometry=cap_2, Material=ColourSwatch(SwatchColor=RGB(115, 209, 204)))
move_5 = Move(Geometry=area_4.Centroid, Motion=Z_6)  # -> simplify(Geometry), Transform
filter_8 = StreamFilter(Gate=input_solar_4, Stream1=move_4.Geometry)
tstat = TreeStatistics(Tree=move_5.Geometry)  # -> flatten(Paths), Length, Count
filter_9 = StreamFilter(Gate=Toggle(True), Stream1=geo_7)
area_5 = Area(Geometry=filter_8)  # -> Area, Centroid
jitter = Jitter(List=tstat.Paths, Jitter=1, Seed=Slider(8, range=0..10))  # -> Values, Indices
Z_7 = UnitZ(Factor=Slider(0.0519, range=0..1))
treemaker = TreeMaker(geo=filter_9)  # -> R, C, M, data_2
split_6 = SplitList(List=jitter.Values, Index=Slider(1, range=0..10))  # -> ListA, ListB
larger_2 = LargerThan(FirstNumber=area_5.Area, SecondNumber=Slider(0.3, range=0..1))  # -> LargerThan, OrEqualTo
runion_2 = RegionUnion(Curves=filter_9)
extr_5 = Extrude(Base=runion_2, Direction=Z_7)
panel_59 = Panel(area_5.Area)
dispatch_4 = Dispatch(List=filter_8, DispatchPattern=larger_2.LargerThan)  # -> ListA, ListB
panel_60 = Panel(split_6.ListA)
branch = TreeBranch(Tree=move_5.Geometry, Path=split_6.ListA, MaintainPaths=True)
preview_9 = CustomPreview(Geometry=treemaker.M, Material=treemaker.data_2)
cluster_3 = Cluster_2(geo=dispatch_4.ListA, num=Slider(-0.1109, range=-1..0))
avr = Average(Input=branch)
cap_3 = CapHoles(Brep=extr_5)
input_parks_7 = RemoteReceiver(input_parks_2)
preview_10 = CustomPreview(Geometry=treemaker.R, Material=treemaker.C)
geo_8 = Geometry(cluster_3)
preview_11 = CustomPreview(Geometry=cap_3, Material=ColourSwatch(SwatchColor=RGB(84, 191, 65)))
input_parks_8 = RemoteReceiver(input_parks_2)
bbox = BoundingBox(Content=geo_8, Plane=PlaneXY(0, 0, 0))  # -> Box, Box_2
input_commgfa_7 = RemoteReceiver(input_commgfa_2)
input_commgfa_8 = RemoteReceiver(input_commgfa_2)
input_tall_timber_5 = RemoteReceiver(input_tall_timber_2)
input_resgfa_7 = RemoteReceiver(input_resgfa_2)
geo_9 = Geometry(<point referenced from the Rhino model>)
input_solar_5 = RemoteReceiver(input_solar_2)
input_resgfa_8 = RemoteReceiver(input_resgfa_2)
box_corners = BoxCorners(Box=bbox.Box)  # -> CornerA, CornerB, CornerC, CornerD, CornerE, CornerF, CornerG, CornerH
geo_10 = Geometry(box_corners.CornerA)
yz = YZPlane(Origin=geo_10)
rotate = Rotate(Geometry=geo_8, Angle=Slider(0.1961, range=0..1), Plane=yz)  # -> Geometry, Transform
Z_8 = UnitZ(Factor=Slider(0.0525, range=0..1))
concat = Concatenate(
    FragmentA="Residential GFA: ",
    FragmentB=input_resgfa_8,
    FragmentC="Commercial GFA: ",
    FragmentD=input_commgfa_7,
    FragmentE="Parks: ",
    FragmentF=input_parks_7,
    FragmentI="Tall Timber? : ",
    FragmentG=input_tall_timber_5,
    FragmentJ="Solar? : ",
    FragmentH=input_solar_5)
number_slider_12 = Slider(3, range=0..10)
output_qol_4 = RemoteReceiver(output_qol)
move_6 = Move(Geometry=rotate.Geometry, Motion=Z_8)  # -> Geometry, Transform
tag = TextTag(Location=avr, Text=concat, Colour=ColourSwatch(SwatchColor=RGB(0, 0, 0)))
grid = GridStructure(Surface=move_6.Geometry, UDivisions=number_slider_12, VDivisions=number_slider_12)  # -> StructureLines, StructureNodes
boundary_6 = BoundarySurfaces(Edges=move_6.Geometry)
tag_2 = TextTag3D(
    Location=geo_9,
    Text=concat,
    Size=Slider(0.556, range=0..1),
    Colour=ColourSwatch(SwatchColor=RGB(0, 0, 0)),
    Justification=1)
geo_11 = Geometry(grid.StructureLines)
geo_12 = Geometry(<point referenced from the Rhino model>)
preview_12 = CustomPreview(Geometry=boundary_6, Material=ColourSwatch(SwatchColor=RGB(64, 64, 64)))
output_revenue_4 = RemoteReceiver(output_revenue)
output_sustainability_4 = RemoteReceiver(output_sustainability)
output_cost_4 = RemoteReceiver(output_cost)
previewlw_2 = CustomPreviewLineweights(Geometry=geo_11, Shader=ColourSwatch(SwatchColor=RGB(191, 191, 191)), Thickness=Slider(2, range=0..10), Absolute=False)
output_qol_5 = RemoteReceiver(output_qol)
concat_2 = Concatenate(
    FragmentG="Cost: ",
    FragmentJ=output_cost_4,
    FragmentH="$: ",
    FragmentK=output_revenue_4,
    FragmentL="Sustainability: ",
    FragmentM=output_sustainability_4,
    FragmentN="Quality of Life: ",
    FragmentO=output_qol_5)
tag_3 = TextTag3D(
    Location=geo_12,
    Text=concat_2,
    Size=Slider(0.556, range=0..1),
    Colour=ColourSwatch(SwatchColor=RGB(0, 0, 0)),
    Justification=1)

# ==== cluster GSLoadCalibrationData
optional_filename = ClusterInput()
update = ClusterInput()
readcalibrationfile = ReadCalibrationFile(update=update, _0=optional_filename)
decodecalibrationdata = DecodeCalibrationData(jsondump=readcalibrationfile)  # -> calibrationmmv_2, calibrationadjustment_2, playspacerectangle_2
calibrationmmv = ClusterOutput(decodecalibrationdata.calibrationmmv_2)
calibrationadjustment = ClusterOutput(decodecalibrationdata.calibrationadjustment_2)
playspacerectangle = ClusterOutput(decodecalibrationdata.playspacerectangle_2)

# ==== cluster ParseCalibratedData
calibrateddata = ClusterInput()
calibrateddata_2 = Data(calibrateddata)
split_list = SplitList(List=calibrateddata_2, Index="1")  # -> ListA, ListB
partition_list = PartitionList(List=split_list.ListB, Size="4")
list_item = ListItem(List=partition_list, Index=0, Wrap=True)  # -> Item, Item1, Item2, Item3
construct_point = ConstructPoint(XCoordinate=list_item.Item1, YCoordinate=list_item.Item2, ZCoordinate=0)
multiplication = Multiplication(A=list_item.Item3, B="2 * Pi")
xy_plane = XYPlane(Origin=construct_point)
rotate_plane = RotatePlane(Plane=xy_plane, Angle=multiplication)
calibratedanglesfrom0to1 = RemoteSender(list_item.Item3)
calibratedplanes = RemoteSender(rotate_plane)
calibratedids = RemoteSender(list_item.Item)
entwine = Entwine(
    Branch00=simplify(calibratedids),
    Branch01=simplify(calibratedanglesfrom0to1),
    Branch02=simplify(calibratedplanes),
    FlattenInputs=True)
calibratedids_2 = ClusterOutput(calibratedids)
calibratedplanes_2 = ClusterOutput(calibratedplanes)
calibratedanglesfrom0to1_2 = ClusterOutput(calibratedanglesfrom0to1)
allcalibrateddata = Data(entwine)
allcalibrateddata_2 = ClusterOutput(allcalibrateddata)

# ==== cluster PHFindTagsV6
allcalibrateddata = ClusterInput()
allcalibrateddata_2 = Data(simplify(allcalibrateddata))
explode_tree = ExplodeTree(Data=allcalibrateddata_2)  # -> Branch0, Branch1, Branch2
calibratedids = Data(simplify(graft(explode_tree.Branch0)))
calibratedanglesfrom0to1 = Number(simplify(graft(explode_tree.Branch1)))
calibratedplanes = Data(simplify(graft(explode_tree.Branch2)))
tag_id = ClusterInput()
tag_id_2 = Number(tag_id)
match = MatchTree(Tree=calibratedplanes, Guide=calibratedids)
match_2 = MatchTree(Tree=calibratedanglesfrom0to1, Guide=calibratedids)
equality = Equality(FirstNumber=graft(tag_id_2), SecondNumber=simplify(flatten(calibratedids)))  # -> Equality, Inequality
tree_statistics = TreeStatistics(Tree=calibratedids)  # -> Paths, Length, Count
panel = Panel(calibratedplanes)
dispatch = Dispatch(List=tree_statistics.Paths, DispatchPattern=equality.Equality)  # -> ListA, ListB
panel_2 = Panel(tree_statistics.Paths)
tree_branch = TreeBranch(Tree=match, Path=dispatch.ListA, MaintainPaths=True)
tree_branch_2 = TreeBranch(Tree=match_2, Path=dispatch.ListA, MaintainPaths=True)
null_item = NullItem(Item=tree_branch_2)  # -> NullFlags, InvalidFlags, Description
gate_not = GateNot(A=null_item.NullFlags)
tag_id_exists = Boolean(gate_not)
calibrated_planes = Plane(tree_branch)
tag_id_exists_2 = ClusterOutput(tag_id_exists)
calibrated_planes_2 = ClusterOutput(calibrated_planes)
anglefrom0to1 = Number(tree_branch_2)
anglefrom0to1_2 = ClusterOutput(anglefrom0to1)

# ==== cluster MovePlane
vector = ClusterInput()
plane = ClusterInput()
vector_2 = Vector(vector)
plane_2 = Plane(plane)
deconstruct = Deconstruct(Point=vector_2)  # -> XComponent, YComponent, ZComponent
point_oriented = PointOriented(
    BasePlane=plane_2,
    UComponent=deconstruct.XComponent,
    VComponent=deconstruct.YComponent,
    WComponent=deconstruct.ZComponent)
align_planes = AlignPlanes(Planes=point_oriented, Master=plane_2)
planes = ClusterOutput(align_planes)

# ==== cluster PrototypeTAGS
anglefrom0to1 = ClusterInput()
surface = ClusterInput()
point = ClusterInput()
anglefrom0to1_2 = Number(anglefrom0to1)
evaluate_surface = EvaluateSurface(Surface=reparameterize(surface), Point=point)  # -> Point, Normal, UDirection, VDirection, Frame
multiplication = Multiplication(A=anglefrom0to1_2, B="2 * Pi")
xy_plane = XYPlane(Origin=evaluate_surface.Point)
boolean = ClusterInput()
rotate_plane = RotatePlane(Plane=xy_plane, Angle=multiplication)
boolean_2 = Boolean(boolean)
anglefrom0to1_3 = Number(anglefrom0to1_2)
calibrated_planes = Plane(rotate_plane)
tag_id_exists = Boolean(boolean_2)
anglefrom0to1_4 = ClusterOutput(anglefrom0to1_3)
tag_id_exists_2 = ClusterOutput(tag_id_exists)
calibrated_planes_2 = ClusterOutput(calibrated_planes)

# ==== cluster DataToJson
calibratedids = ClusterInput()
calibratedanglesfrom0to1 = ClusterInput()
calibratedplanes = ClusterInput()
python = GhPythonScript(
    CalibratedIDs=simplify(flatten(calibratedids)),
    CalibratedAnglesFrom0To1=simplify(flatten(calibratedanglesfrom0to1)),
    CalibratedPlanes=simplify(flatten(calibratedplanes)))  # -> out, JSONmsg; inputs CalibratedIDs: list, CalibratedAnglesFrom0To1: list, CalibratedPlanes: list of Plane
# ---------- python: Python ----------
from ghpythonlib import treehelpers
import json
#print(treehelpers.tree_to_list(CalibratedIDs))
print(CalibratedIDs)

msg = {}
for d in zip(CalibratedIDs, CalibratedAnglesFrom0To1, CalibratedPlanes):

    id = d[0]
    ang = d[1]
    plane = d[2]
    msg[id] = {}
    msg[id]["id"] = id
    msg[id]["angle_from_0_to_1"] = d[1]
    msg[id]["pos"] = { "x": plane.Origin[0], "y": plane.Origin[1] }

print(msg)
JSONmsg = json.dumps(msg)
#
# ---------- end python ----------
jsonmsg = ClusterOutput(python.JSONmsg)

# ==== cluster BuildingMaker
P = ClusterInput()
R = ClusterInput()
number_slider = Slider(7, range=0..10)
F = ClusterInput()
number_slider_2 = Slider(9, range=0..10)
cluster = Cluster(P=P, A=R, B=F)
max = Maximum(A=F, B=Slider(4, range=0..10))
multiplication = Multiplication(A="2", B=max)
polygon = Polygon(Plane=P, Radius=R, Segments=multiplication, FilletRadius=0)  # -> Polygon, Length
polygon_2 = Polygon(Plane=P, Radius=R, Segments=multiplication, FilletRadius=0)  # -> Polygon, Length
cp = ControlPoints(Curve=polygon.Polygon)  # -> Points, Weights, Knots
cp_2 = ControlPoints(Curve=polygon_2.Polygon)  # -> Points, Weights, Knots
panel = Panel(cluster)
number_slider_3 = Slider(2, range=0..10)
jitter = Jitter(List=cp.Points, Jitter=1, Seed=Slider(9, range=0..100))  # -> Values, Indices
number_slider_4 = Slider(3, range=0..10)
jitter_2 = Jitter(List=cp_2.Points, Jitter=1, Seed=cluster)  # -> Values, Indices
split = SplitList(List=jitter.Values, Index=max)  # -> ListA, ListB
split_2 = SplitList(List=jitter_2.Values, Index=max)  # -> ListA, ListB
geo = Geometry(split.ListB)
geo_2 = Geometry(split_2.ListB)
alongcrv = SortAlongCurve(Points=geo, Curve=polygon.Polygon)  # -> Points, Indices
alongcrv_2 = SortAlongCurve(Points=geo_2, Curve=polygon_2.Polygon)  # -> Points, Indices
pline = PolyLine(Vertices=alongcrv.Points, Closed=True)
pline_2 = PolyLine(Vertices=alongcrv_2.Points, Closed=True)
area = Area(Geometry=pline_2)  # -> Area, Centroid
scale = Scale(Geometry=pline_2, Center=area.Centroid, Factor=Slider(1, range=0..1))  # -> Geometry, Transform
random = Random(Range=Domain(0, 1), Number=1, Seed=2)
multiplication_2 = Multiplication(A=random, B="2 * Pi")
Z = UnitZ(Factor=F)
rotate = Rotate(Geometry=scale.Geometry, Angle=multiplication_2, Plane=area.Centroid)  # -> Geometry, Transform
move = Move(Geometry=scale.Geometry, Motion=Z)  # -> Geometry, Transform
merge = Merge(Data1=move.Geometry, Data2=pline)
loft = Loft(Curves=merge, Options={Adjust=True, Closed=False, LoftEnds=0, LoftSimp=0, LoftType=1, Rebuild=10, Refit=0.01})
cap = CapHoles(Brep=loft)
geo_3 = Geometry(cap)
bbox = BoundingBox(Content=geo_3, Plane=PlaneXY(0, 0, 0))  # -> Box, Box_2
debox = DeconstructBox(Box=bbox.Box)  # -> Plane, X, Y, Z
num = Number(debox.Z)
division = Division(A=num, B=Slider(1, range=0..10))
round = Round(Number=division)  # -> Nearest, Floor, Ceiling
B = ClusterOutput(cap)
division_2 = Division(A=num, B=round.Floor)
subtraction = Subtraction(A=division_2, B=Slider(0.01, range=0..0.01))
contour = Contour(Shape=geo_3, Point=Point(0, 0, 0), Direction=Vector(0, 0, 1), Distance=subtraction)
boundary = BoundarySurfaces(Edges=contour)
Z_2 = UnitZ(Factor=Slider(0.2, range=0..1))
geo_4 = Geometry(geo_3)
number_slider_5 = Slider(0.1, range=0..1)
debrep = DeconstructBrep(Brep=geo_4)  # -> Faces, Edges, Vertices
pipe = Pipe(Radius=1, Caps=0)
extr = Extrude(Base=boundary, Direction=Z_2)
boxnotpipe_straightlines = BoxNotPipe_STRAIGHTLINES(geo=debrep.Edges, num=Slider(0.05, range=0..0.1))
merge_2 = Merge(Data1=boxnotpipe_straightlines, Data2=extr)
R_2 = ClusterOutput(merge_2)

# ==== cluster Cluster_2
geo = ClusterInput()
num = ClusterInput()
geo_2 = Geometry(geo)
num_2 = Number(num)
neg = Negative(Value=num_2)
offset = OffsetCurve(Curve=geo_2, Distance=neg, Plane=PlaneXY(0, 0, 0), Corners=1)
offset_2 = OffsetCurve(Curve=geo_2, Distance=num_2, Plane=PlaneXY(0, 0, 0), Corners=1)
area = Area(Geometry=offset)  # -> Area, Centroid
area_2 = Area(Geometry=offset_2)  # -> Area, Centroid
merge = Merge(Data1=offset, Data2=offset_2)
smaller = SmallerThan(FirstNumber=area.Area, SecondNumber=area_2.Area)  # -> SmallerThan, OrEqualTo
int = Integer(smaller.SmallerThan)
item = ListItem(List=merge, Index=int, Wrap=True)  # -> Item, Item1
geo_3 = Geometry(item.Item1)
geo_4 = ClusterOutput(geo_3)
panel = Panel(item.Item)

# ==== cluster StandardDeviation: StandardDeviation
data = ClusterInput()
data_2 = Data(data)
avr = Average(Input=data_2)
subtraction = Subtraction(A=data_2, B=avr)
sqr = Square(Value=subtraction)
avr_2 = Average(Input=sqr)
sqrt = SquareRoot(Value=avr_2)
y = ClusterOutput(sqrt)

# ==== cluster TreeMaker
geo = ClusterInput()
geo_2 = Geometry(geo)
area = Area(Geometry=geo_2)  # -> Area, Centroid
sqrt = SquareRoot(Value=area.Area)
division = Division(A=sqrt, B=Slider(3, range=0..10))
division_2 = Division(A=area.Area, B=Slider(0.7, range=0..1))
cir = Circle(Plane=area.Centroid, Radius=division)
popgeo = PopulateGeometry(Geometry=cir, Count=division_2, Seed=1)
number_slider = Slider(0.5, range=0..1)
panel = Panel(division_2)
polygon = Polygon(Plane=popgeo, Radius=Slider(0.03727, range=0..0.1), Segments=6, FilletRadius=0)  # -> Polygon, Length
Z = UnitZ(Factor=number_slider)
Z_2 = UnitZ(Factor=1)
extr = Extrude(Base=polygon.Polygon, Direction=Z)
panel_2 = Panel(popgeo)
line = LineSDL(Start=popgeo, Direction=Z_2, Length=number_slider)
number_slider_2 = Slider(4, range=0..10)
mesh = MeshBrep(
    Brep=extr,
    Settings={GridMaxCount=0, GridMinCount=16, JaggedSeams=False, MaxEdgeLength=0, MinEdgeLength=0.0001, MinTolerance=0, Refine=True, RefineAngle=0, RelativeTolerance=0.65, SimplePlanes=True, Tolerance=0})
end = EndPoints(Curve=line)  # -> Start, End
msphere = MeshSphere(Base=end.End, Radius=Slider(0.1529, range=0..1), UCount=number_slider_2, VCount=number_slider_2)
pdecon = Deconstruct(Point=popgeo)  # -> XComponent, YComponent, ZComponent
addition = Addition(A=pdecon.XComponent, B=pdecon.YComponent, C=pdecon.ZComponent)
lng = ListLength()
dom = ConstructDomain(DomainStart=Slider(0.296, range=0..1), DomainEnd=Slider(1, range=0..1))
popgeo_2 = PopulateGeometry(Geometry=msphere, Count=Slider(4, range=0..10), Seed=addition)
lng_2 = ListLength(List=popgeo_2)
number_slider_3 = Slider(4, range=0..10)
random = Random(Range=dom, Number=lng_2, Seed=addition)
multiplication = Multiplication(A=Slider(0.1154, range=0..1), B=random)
random_2 = Random(Range=Domain(0, 1), Number=lng_2, Seed=addition)
msphere_2 = MeshSphere(Base=popgeo_2, Radius=multiplication, UCount=number_slider_3, VCount=number_slider_3)
gradient = Gradient(LowerLimit=0, UpperLimit=1, Parameter=random_2, stops=[0.15: RGB(47, 105, 24), 0.85: RGB(74, 186, 34)])
merge = Merge(Data1=msphere, Data2=msphere_2)
R = ClusterOutput(merge)
M = ClusterOutput(mesh)
C = ClusterOutput(gradient)
data = Data(ColourSwatch(SwatchColor=RGB(145, 103, 41)))
data_2 = ClusterOutput(data)

# ==== cluster DecodeCalibrationData
jsondump = ClusterInput()
b64dump = ClusterInput()
deserializedata = DEserializeData(jsondump=jsondump, b64dump=b64dump)  # -> keys, vals
bang = ExplodeTree(Data=deserializedata.vals)  # -> Branch0, Branch1, Branch2
playspacerectanglepts = Geometry(bang.Branch2)
calibrationadjustment = Point(bang.Branch1)
calibrationmmv = Number(bang.Branch0)
polyline = PolyLine(Vertices=playspacerectanglepts, Closed=True)
calibrationmmv_2 = ClusterOutput(calibrationmmv)
calibrationadjustment_2 = ClusterOutput(calibrationadjustment)
playspacerectangle = Geometry(polyline)
playspacerectangle_2 = ClusterOutput(playspacerectangle)

# ==== cluster ReadCalibrationFile
update = ClusterInput()
_0 = ClusterInput()
update_2 = Data(update)
gh_filepath = GHFilepath()  # -> filepath, filedir
combine = CombineData(Input0=_0, Input1="calibration.csv")  # -> Result, Index
writecalibrationfile = GhPythonScript(update=update_2, filedir=gh_filepath.filedir, filename=combine.Result)  # -> out, jsondump
# ---------- writecalibrationfile: Python ----------
import ghpythonlib.treehelpers as th
import json
import os 


filepath = os.path.join(filedir, filename)

print filepath

with open(filepath, "r") as f:
    jsondump = f.read()
# ---------- end writecalibrationfile ----------
jsondump = ClusterOutput(writecalibrationfile.jsondump)
panel = Panel(writecalibrationfile.jsondump)

# ==== cluster Cluster
B = ClusterInput()
P = ClusterInput()
pdecon = Deconstruct(Point=P)  # -> XComponent, YComponent, ZComponent
multiplication = Multiplication(A="10", B=B)
multiplication_2 = Multiplication(A=pdecon.XComponent, B="10")
multiplication_3 = Multiplication(A=pdecon.YComponent, B="10")
A = ClusterInput()
multiplication_4 = Multiplication(A=pdecon.ZComponent, B="10")
addition = Addition(A=multiplication_2, B=multiplication_3, C=multiplication_4, D=A, E=multiplication)
R = ClusterOutput(addition)

# ==== cluster BoxNotPipe_STRAIGHTLINES
num = ClusterInput()
geo = ClusterInput()
num_2 = Number(num)
geo_2 = Geometry(geo)
end = EndPoints(Curve=geo_2)  # -> Start, End
neg = Negative(Value=num_2)
pl = PlaneNormal(Origin=end.Start, ZAxis=geo_2)
len = Length(Curve=geo_2)
dom = ConstructDomain(DomainStart=neg, DomainEnd=num_2)
box = DomainBox(Base=pl, X=dom, Y=dom, Z=len)
B = ClusterOutput(box)

# ==== cluster DEserializeData
jsondump = ClusterInput()
b64dump = ClusterInput()
or = ClusterInput()
or_2 = Data(or)
python = GhPythonScript(jsondump=jsondump, b64dump=b64dump)  # -> out, keys, vals
# ---------- python: Python ----------
import ghpythonlib.treehelpers as th
import json
import base64


thisjsondump = jsondump
if(b64dump):
    thisjsondump = base64.b64decode(b64dump)

d = json.loads(thisjsondump)
keys = th.list_to_tree(d["keys"])
vals = th.list_to_tree(d["vals"])
# ---------- end python ----------
vals = ClusterOutput(python.vals)
keys = ClusterOutput(python.keys)

# ==== cluster GHFilepath
get_gh_filepath = GetGHFilepath()  # -> filepath, filedir
filedir = ClusterOutput(get_gh_filepath.filedir)
panel = Panel(get_gh_filepath.filepath)
filepath = ClusterOutput(get_gh_filepath.filepath)

# ==== cluster GetGHFilepath
get_gh_filepath = GhPythonScript()  # -> out, filepath, filedir
# ---------- get_gh_filepath: Python ----------
import os


thisdoc = ghenv.Component.OnPingDocument()

while thisdoc.FilePath is None:
    #we are inside a cluster
    thisdoc = thisdoc.Owner.OwnerDocument()

filepath = thisdoc.FilePath
filedir = os.path.dirname(filepath)
# ---------- end get_gh_filepath ----------
filedir = ClusterOutput(get_gh_filepath.filedir)
filepath = ClusterOutput(get_gh_filepath.filepath)
